vi "Get Earthquake Count.gviweb"   [LabVIEW NXG 2.0.0]
inputs:
  "JSON in": string
  "error in": error
outputs:
  "error out": error
  "Earthquake count": f64
types:
  T1 = cluster{"generated": f64, "url": string, "title": string, "status": f64, "api": string, "count": f64}
diagram:
  w1 = T1 {all zero or empty}  # metadata
  Unflatten From JSON(JSON string=$"JSON in", error in (no error)=$"error in", path=["metadata"], type and defaults=w1) -> (error out=w2, value=w3)
  Property Node(instance in=w3) -> ("count"=w4)
  $"Earthquake count" <- w4
  $"error out" <- w2
