vi "Get Earthquake Info.gviweb"   [LabVIEW NXG 2.0.0]
inputs:
  "JSON in": string
  "Earthquake Index": i32
  "Error in": error
outputs:
  "id": string
  "Magnitude": f64
  "Location": string
  "Is Valid?": bool
  "Error out": error
  "detail": string
panel indicators:
  "URL": string
  "Time": f64
types:
  T1 = cluster{"mag": f64, "place": string, "time": f64, "updated": f64, "tz": f64, "url": string, "detail": string, "felt": f64, "cdi": f64, "mmi": f64, "alert": string, "status": string, "tsunami": f64, "title": string, "net": string, "code": string}
diagram:
  w1 = cluster{"type": string, "properties": T1} {all zero or empty}  # metadata
  Format Into String(formatString="%d", errIn=$"Error in", $"Earthquake Index") -> (outString=w2, errOut=w3)
  Build Array("features", w2) -> w4
  Unflatten From JSON(JSON string=$"JSON in", default null elements=TRUE, error in (no error)=w3, path=w4, type and defaults=w1) -> (error out=w5, value=w6)
  Is Not Equal[ComparisonMode=CompareAggregates](x=w6, y=w1) -> w7
  # Temporarily working around a bug in Unflatten from JSON that prevents it from getting to id in the JSON
  # Instead we extract it from the end of the URL by reversing, finding the first /, then undoing the reverse.
  $"Is Valid?" <- w7
  Property Node(instance in=w6) -> ("properties:mag"=w8, "properties:url"=w9, "properties:place"=w10, "properties:time"=w11, "properties:detail"=w12)
  $Magnitude <- w8
  Reverse String(string=w9) -> (reversed=w13)
  Match Pattern(regular expression="\\/", string=w13) -> (before substring=w14)
  Reverse String(string=w14) -> (reversed=w15)
  $id <- w15
  $URL <- w9
  $Location <- w10
  $Time <- w11
  $detail <- w12
  $"Error out" <- w5
