vi "Get Map URL.gviweb"   [LabVIEW NXG 2.0.0]
inputs:
  "detail url": string, required
  "id": string, required
  "error in": error
outputs:
  "Image URL": string
  "error out": error
panel indicators:
  "body": string
uses:
  NI::HTTP::GET.gvi
diagram:
  w1 = "https://earthquake.usgs.gov/realtime/product/losspager/%s/us/[0-9]+/exposure.png"
  Format Into String(formatString=w1, errIn=$"error in", $id) -> (outString=w2, errOut=w3)
  $"error out" <- w3
  call "GET.gvi"(url=$"detail url", error in=$"error in") -> (body=w4)
  Match Pattern(regular expression=w2, string=w4) -> (match substring=w5)
  $"Image URL" <- w5
  $body <- w4
