vi "Get Recent Earthquakes.gviweb"   [LabVIEW NXG 2.0.0]
inputs:
  "error in": error
outputs:
  "Earthquakes": T1[]
  "error out": error
panel indicators:
  "JSON": string
types:
  T1 = cluster{"map url": string, "location": string, "latitude": f64, "longitude": f64, "depth": f64, "magnitude": f64}
uses:
  NI::HTTP::GET.gvi
  Application::Get Map URL.gviweb
diagram:
  w1 = "https://earthquake.usgs.gov/earthquakes/feed/v1.0/summary/significant_month.geojson"
  call "GET.gvi"(url=w1, error in=$"error in") -> (body=w2, error out=w3)
  $JSON <- w2
  call "Get Earthquake Count.gviweb"(JSON in=w2, error in=w3) -> (Earthquake count=w4, error out=w5)
  s1 = w5  # shift register
  for (N = w4) (iteration -> i1) {
    call "Get Earthquake Info.gviweb"(JSON in=w2, Earthquake Index=i1, Error in=s1) -> (id=w7, Magnitude=w8, Location=w9, Is Valid?=w10, Error out=w11, detail=w12)
    call "Get Earthquake Location.gviweb"(JSON in=w2, Earthquake index=i1, error in=w11) -> (latitude=w13, longitude=w14, depth=w15, error out=w16)
    call "Get Map URL.gviweb"(detail url=w12, id=w7, error in=w16) -> (Image URL=w17, error out=w18)
    Property Node(instance in=T1 {all zero or empty}, "map url"=w17, "latitude"=w13, "longitude"=w14, "depth"=w15, "location"=w9, "magnitude"=w8) -> (instance out=w19)
    append w19 to w6 if w10
    next s1 = w18
  }
  $Earthquakes <- w6
  $"error out" <- s1
