vi "Main.gviweb"   [LabVIEW NXG 2.0.0]
panel controls:
  "Sample Length (s)": i32 = 10
  "Signal Amplitude": f64 = 1
  "Sample Rate (Hz)": i32 = 100
  "Noise %": f64 = 25
  "Signal Frequency": f64 = 1
panel indicators:
  "Observed Data and Fitted Curve": cluster{"Element 1": f64, "Element 2": f64}[][]
  "Signal": cluster{"Element 1": f64, "Element 2": f64}[]
  "Spectrum": cluster{"Element 1": f64, "Element 2": f64}[]
types:
  T1 = cluster{"X": f64[], "Y": f64[], "Best Gaussian Fit": f64[], "Upper Bound": f64[], "Lower Bound": f64[]}
  T2 = cluster{"Samples": i32, "Amplitude": f64, "Frequency": f64, "Noise%": f64}
uses:
  NI::HTTP::GET.gvi
  NI::HTTP::POST Buffer.gvi
diagram:
  while {
    Wait(time to wait=500)
    call "GET.gvi"(url="http://127.0.0.1:8001/Web_Server/ParametricCurve") -> (body=w1)
    Unflatten From JSON(JSON string=w1, type and defaults=T1 {all zero or empty}) -> (value=w2)
    Property Node(instance in=w2) -> ("X"=w3, "Y"=w4, "Best Gaussian Fit"=w5, "Upper Bound"=w6, "Lower Bound"=w7)
    Build Index And Bundle Cluster Array(w3, w4) -> (out=w8)
    Build Index And Bundle Cluster Array(w3, w5) -> (out=w9)
    Build Index And Bundle Cluster Array(w3, w6) -> (out=w10)
    Build Index And Bundle Cluster Array(w3, w7) -> (out=w11)
    Build Array(w8, w9, w10, w11) -> w12
    $"Observed Data and Fitted Curve" <- w12
    stop if FALSE
  }
  # http://127.0.0.1:8001/Web_Server/SignalAndSpectrum
  while {
    Wait(time to wait=1000)
    Reciprocal(x=$"Sample Rate (Hz)") -> w13
    w14 = cluster{"Signal": f64[], "Spectrum": f64[]} {all zero or empty}
    Multiply($"Sample Length (s)", $"Sample Rate (Hz)") -> w15
    Divide(x=$"Signal Frequency", y=$"Sample Rate (Hz)") -> w16
    Property Node(instance in=T2 {all zero or empty}, "Samples"=w15, "Frequency"=w16, "Amplitude"=$"Signal Amplitude", "Noise%"=$"Noise %") -> (instance out=w17)
    Flatten To JSON(anything=w17) -> (JSON string=w18)
    call "POST Buffer.gvi"(url="http://127.0.0.1:8001/Web_Server/SignalAndSpectrum", buffer=w18) -> (body=w19)
    Unflatten From JSON(JSON string=w19, type and defaults=w14) -> (value=w20)
    Property Node(instance in=w20) -> ("Signal"=w21, "Spectrum"=w22)
    for (iteration -> i1) {
      w23 = each element of w21
      Multiply(i1, w13) -> w25
      Build Cluster(w25, w23) -> w26
      append w26 to w24
    }
    $Signal <- w24
    Reciprocal(x=$"Sample Length (s)") -> w27
    Divide(x=$"Sample Rate (Hz)", y=2) -> w28
    for (iteration -> i2) {
      w29 = each element of w22
      Multiply(w27, i2) -> w31
      Build Cluster(w31, w29) -> w32
      Is Greater(x=w31, y=w28) -> w33
      append w32 to w30
      stop if w33
    }
    $Spectrum <- w30
    stop if FALSE
  }
