vi "index.gviweb"   [G Web Development Software 21.0.0]
panel controls:
  "Map": i32
  "Hyperlink Control": string = "https://github.com/ni/webvi-examples/tree/master/Call3rdPartyWebService"
panel indicators:
  "Earthquakes": T1[]
  "logo": string
  "map url image": string
  "banner": string
types:
  T1 = cluster{"Location": string, "Magnitude": f64, "Latitude": f64, "Longitude": f64, "Depth": f64}
uses:
  WebApp::support::Get Recent Earthquakes.gviweb
diagram:
  call "Get Recent Earthquakes.gviweb"() -> (Earthquakes=w1)
  # Call the Web Service
  for {
    w2 = each element of w1
    # Unflatten the JSON return from Web Service
    Property Node(instance in=w2) -> ("map url"=w5, "location"=w6, "magnitude"=w7, "latitude"=w8, "longitude"=w9, "depth"=w10)
    Property Node(instance in=T1 {all zero or empty}, "Location"=w6, "Magnitude"=w7, "Latitude"=w8, "Longitude"=w9, "Depth"=w10) -> (instance out=w11)
    append w5 to w3
    append w11 to w4
  }
  s1 = $Map  # shift register
  while {
    # Show the earthquake map based on the map url index
    Array Index(array=w3) -> (out0[s1]=w12)
    $"map url image" <- w12
    event {
      on "Map" Value changed {
        w13 = $Map
      }
    }
    next s1 = w13
    stop if FALSE
  }
  # Populate data grid with earthquake date.
  $Earthquakes <- w4
