vi "Get Earthquake Count.gviweb"   [G Web Development Software 22.3.0]
inputs:
  "JSON": string
  "error in": error
outputs:
  "error out": error
  "Earthquake count": f64
types:
  T1 = cluster{"generated": f64, "url": string, "title": string, "status": f64, "api": string, "count": f64}
diagram:
  Unflatten From Json(JSON string=$JSON, error in (no error)=$"error in", path=["metadata"], type and defaults=T1 {all zero or empty}) -> (error out=w1, value=w2)
  Property Node(instance in=w2) -> ("count"=w3)
  $"Earthquake count" <- w3
  $"error out" <- w1
