vi "Get Recent Earthquakes.gviweb"   [LabVIEW NXG 3.1.0]
inputs:
  "error in": error
outputs:
  "error out": error
  "Earthquakes": T1[]
panel indicators:
  "JSON": string
types:
  T1 = cluster{"map url": string, "location": string, "latitude": f64, "longitude": f64, "depth": f64, "magnitude": f64}
uses:
  NI::HTTP::GET.gvi
  WebApp::support::Get Earthquake Count.gviweb
  WebApp::support::Get Earthquake Info.gviweb
  WebApp::support::Get Map URL.gviweb
  WebApp::support::Get Earthquake Location.gviweb
diagram:
  w1 = "https://earthquake.usgs.gov/earthquakes/feed/v1.0/summary/significant_month.geojson"
  call "GET.gvi"(url=w1, error in=$"error in") -> (body=w2, error out=w3)
  $JSON <- w2
  call "Get Earthquake Count.gviweb"(JSON=w2, error in=w3) -> (Earthquake count=w4, error out=w5)
  s1 = w5  # shift register
  for (N = w4) (iteration -> i1) {
    call "Get Earthquake Info.gviweb"(JSON=w2, Earthquake Index=i1, Error in=s1) -> (Location=w7, Magnitude=w8, id=w9, detail=w10, Is Valid?=w11, Error out=w12)
    call "Get Map URL.gviweb"(id=w9, detail url=w10, error in=w12) -> (Image URL=w13, error out=w14)
    call "Get Earthquake Location.gviweb"(JSON=w2, Earthquake index=i1, error in=w14) -> (latitude=w15, longitude=w16, depth=w17, error out=w18)
    Property Node(instance in=T1 {all zero or empty}, "location"=w7, "magnitude"=w8, "map url"=w13, "latitude"=w15, "longitude"=w16, "depth"=w17) -> (instance out=w19)
    append w19 to w6 if w11
    next s1 = w18
  }
  $"error out" <- s1
  $Earthquakes <- w6
