vi "Compare Add.gviweb"   [LabVIEW NXG 3.1.0]
inputs:
  "X": u32
  "Y": u32
outputs:
  "Add VI": u32
  "Add JSLI (Decimal)": u32
  "Add JSLI": bool[]
  "error out": error
uses:
  Calculator Functions::Calculator Functions.jsli::Add JSLI
diagram:
  Add($X, $Y) -> w1
  $"Add VI" <- w1
  call "Add JSLI"(X=$X, Y=$Y) -> (Z=w2, error out=w3)
  $"Add JSLI (Decimal)" <- w2
  Number To Boolean Array(number=w2) -> (Boolean array=w4)
  $"Add JSLI" <- w4
  $"error out" <- w3
