vi "Compare Multiply.gviweb"   [LabVIEW NXG 3.1.0]
inputs:
  "X": u32
  "Y": u32
outputs:
  "Multi VI": u32
  "Multi JSLI (Decimal)": u32
  "Multiply JSLI": bool[]
  "error out": error
uses:
  Calculator Functions::Calculator Functions.jsli::Multiply JSLI
diagram:
  Multiply($X, $Y) -> w1
  $"Multi VI" <- w1
  call "Multiply JSLI"(X=$X, Y=$Y) -> (return=w2, error out=w3)
  $"Multi JSLI (Decimal)" <- w2
  Number To Boolean Array(number=w2) -> (Boolean array=w4)
  $"Multiply JSLI" <- w4
  $"error out" <- w3
