vi "Main.gviweb"   [LabVIEW NXG 3.1.0]
# This example demostrates using the JavaScript Library Interface (JSLI) as a simple 4-bit calculator.
panel controls:
  "X (Binary)": bool[] = [FALSE, FALSE, FALSE, FALSE]
  "Y (Binary)": bool[] = [TRUE, TRUE, TRUE, TRUE]
  "GitHub Hyperlink": string = "https://github.com/ni/webvi-examples/tree/master/CallJavaScriptFromAWebVI"
  "Log": bool
panel indicators:
  "X (Decimal)": u32
  "Y (Decimal)": u32
  "Add (Built-in)": u32
  "Add JSLI": bool[]
  "Add (JSLI)": u32
  "Add JSLI Error": error
  "Multiply (Built-in)": u32
  "Multiply JSLI": bool[]
  "Multiply (JSLI)": u32
  "Multiply JSLI Error": error
  "Log Error": error
uses:
  Calculator::subvis::Compare Add.gviweb
  Calculator::subvis::Compare Multiply.gviweb
  Calculator::subvis::Format Console Log.gviweb
  Calculator Library::Calculator Functions.jsli::Log to Console
diagram:
  # To reference external JavaScript files, you must add script tags to the HTML source panel.
  # This example uses the following script tags.
  #
  # <script src="javascript/Add.js" type="application/javascript"></script>
  # <script src="javascript/Multiply.js" type="application/javascript"></script>
  s1 = $"Y (Binary)"  # shift register
  s2 = FALSE  # shift register
  s3 = $"X (Binary)"  # shift register
  while {
    event {
      on "X (Binary)" Value changed; "Y (Binary)" Value changed {
        w1 = s2
        w2 = $"Y (Binary)"
        w3 = $"X (Binary)"
      }
      on "Log" Value changed {
        w1 = $Log
        w2 = s1
        w3 = s3
      }
    }
    Boolean Array To Number(Boolean array=s3) -> (number=w4)
    $"X (Decimal)" <- w4
    Boolean Array To Number(Boolean array=s1) -> (number=w5)
    $"Y (Decimal)" <- w5
    call "Compare Add.gviweb"(X=w4, Y=w5) -> (Add JSLI (Decimal)=w6, Add VI=w7, Add JSLI=w8, error out=w9)
    $"Add (JSLI)" <- w6
    $"Add (Built-in)" <- w7
    $"Add JSLI" <- w8
    $"Add JSLI Error" <- w9
    call "Compare Multiply.gviweb"(X=w4, Y=w5) -> (Multi JSLI (Decimal)=w10, Multi VI=w11, Multiply JSLI=w12, error out=w13)
    case (s2) {
      frame False, Default {
        w14 = no error
      }
      frame True {
        call "Format Console Log.gviweb"(Add JSLI=w6, Multi JSLI=w10) -> (Formatted String=w15)
        call "Log to Console"(arg=w15) -> (error out=w14)
      }
    }
    $"Log Error" <- w14
    $"Multiply (JSLI)" <- w10
    $"Multiply (Built-in)" <- w11
    $"Multiply JSLI" <- w12
    $"Multiply JSLI Error" <- w13
    next s1 = w2
    next s2 = w1
    next s3 = w3
    stop if FALSE
  }
