vi "Format Console Log.gviweb"   [LabVIEW NXG 5.1.0]
inputs:
  "Add JSLI": u32
  "Multi JSLI": u32
outputs:
  "Formatted String": string
diagram:
  Number To Decimal String(number=$"Add JSLI") -> (decimal integer string=w1)
  Number To Decimal String(number=$"Multi JSLI") -> (decimal integer string=w2)
  Concatenate Strings("X + Y = ", w1, " and X * Y = ", w2) -> w3
  $"Formatted String" <- w3
