vi "Observed Data and Fitted Curve.gviweb"   [LabVIEW NXG 5.1.0]
inputs:
  "String": string
  "error in": error
outputs:
  "error out": error
  "Observed Data and Fitted Curve": cluster{"Element 1": f64, "Element 2": f64}[][]
types:
  T1 = cluster{"X": f64[], "Y": f64[], "Best Gaussian Fit": f64[], "Upper Bound": f64[], "Lower Bound": f64[]}
uses:
  NI::HTTP::GET.gvi
diagram:
  call "GET.gvi"(url=$String, error in=$"error in") -> (body=w1, error out=w2)
  Unflatten From Json(JSON string=w1, error in (no error)=w2, type and defaults=T1 {all zero or empty}) -> (error out=w3, value=w4)
  Property Node(instance in=w4) -> ("X"=w5, "Y"=w6, "Best Gaussian Fit"=w7, "Upper Bound"=w8, "Lower Bound"=w9)
  Build Index And Bundle Cluster Array(w5, w6) -> (out=w10)
  Build Index And Bundle Cluster Array(w5, w7) -> (out=w11)
  Build Index And Bundle Cluster Array(w5, w8) -> (out=w12)
  Build Index And Bundle Cluster Array(w5, w9) -> (out=w13)
  Build Array(w10, w11, w12, w13) -> w14
  $"Observed Data and Fitted Curve" <- w14
  $"error out" <- w3
