vi "Main.gviweb"   [LabVIEW NXG 2.0.0]
panel controls:
  "Sample Length (s)": i32 = 10
  "Signal Amplitude": f64 = 1
  "Sample Rate (Hz)": i32 = 100
  "Noise %": f64 = 25
  "Signal Frequency": f64 = 1
  "Hyperlink Control": string = "https://github.com/ni/webvi-examples/tree/ad0a92c4696674f290b4e2a02c514360be7b299d/Call%20LabVIEW%20Web%20Service"
  "Hyperlink Control_2": string = "https://github.com/ni/webvi-examples/tree/ad0a92c4696674f290b4e2a02c514360be7b299d/Call%20LabVIEW%20Web%20Service"
  "URL Configuration": T1 = "Use Absolute URLs and Local Debugging"
panel indicators:
  "Observed Data and Fitted Curve": cluster{"Element 1": f64, "Element 2": f64}[][]
  "Signal": cluster{"Element 1": f64, "Element 2": f64}[]
  "Spectrum": cluster{"Element 1": f64, "Element 2": f64}[]
  "LED": bool
types:
  T1 = enum{"Use Absolute URLs and Local Debugging", "Use Relative URLs and Application Web Server"}
  T2 = cluster{"X": f64[], "Y": f64[], "Best Gaussian Fit": f64[], "Upper Bound": f64[], "Lower Bound": f64[]}
  T3 = cluster{"Samples": i32, "Amplitude": f64, "Frequency": f64, "Noise%": f64}
uses:
  NI::G Core::Error::Clear Error Cluster.gvi
  NI::HTTP::GET.gvi
  NI::HTTP::POST Buffer.gvi
diagram:
  s1 = uninitialised  # shift register
  while {
    Wait(time to wait=500)
    case ($"URL Configuration") {
      frame "Use Absolute URLs and Local Debugging", Default {
        w1 = "http://127.0.0.1:8001/Web_Server/"
      }
      frame "Use Relative URLs and Application Web Server" {
        w1 = ""
      }
    }
    Concatenate Strings(w1, "ParametricCurve") -> w2
    Concatenate Strings(w1, "SignalAndSpectrum") -> w3
    case (s1) {
      frame Error, Default {
        $LED <- TRUE
        call "Clear Error Cluster.gvi"(error in=s1) -> (error out=w5)
        # If there is an error, highlight the text pointing to where to download the LabVIEW Web service. HTTP errors are mostly likely due to the Web service not running.
        #
        # Check on each loop iteration to ensure there Web server is still down by clearing the error and calling GET. This allows us to exit the error state if the Web server comes back while the example is running.
        call "GET.gvi"(url=w2, error in=w5) -> (error out=w4)
      }
      frame No Error {
        $LED <- FALSE
        # Get data from LabVIEW Web service, unflatten the data, and format it so it can be displayed in a single graph.
        #
        # Post data to LabVIEW Web service, unflatten the  response data, format the data, and plot on two graphs
        Divide(x=$"Sample Rate (Hz)", y=2) -> w6
        call "GET.gvi"(url=w2, error in=s1) -> (body=w7, error out=w8)
        Unflatten From JSON(JSON string=w7, error in (no error)=w8, type and defaults=T2 {all zero or empty}) -> (error out=w9, value=w10)
        Multiply($"Sample Length (s)", $"Sample Rate (Hz)") -> w11
        Divide(x=$"Signal Frequency", y=$"Sample Rate (Hz)") -> w12
        Property Node(instance in=T3 {all zero or empty}, "Samples"=w11, "Frequency"=w12, "Amplitude"=$"Signal Amplitude", "Noise%"=$"Noise %") -> (instance out=w13)
        Flatten To JSON(anything=w13, error in (no error)=w9) -> (JSON string=w14, error out=w15)
        call "POST Buffer.gvi"(url=w3, buffer=w14, error in=w15) -> (body=w16, error out=w17)
        w18 = cluster{"Signal": f64[], "Spectrum": f64[]} {all zero or empty}
        Unflatten From JSON(JSON string=w16, error in (no error)=w17, type and defaults=w18) -> (error out=w4, value=w19)
        Property Node(instance in=w19) -> ("Signal"=w20, "Spectrum"=w21)
        Reciprocal(x=$"Sample Length (s)") -> w22
        for (iteration -> i1) {
          w23 = each element of w21
          Multiply(w22, i1) -> w25
          Build Cluster(w25, w23) -> w26
          Is Greater(x=w25, y=w6) -> w27
          append w26 to w24
          stop if w27
        }
        $Spectrum <- w24
        Reciprocal(x=$"Sample Rate (Hz)") -> w28
        for (iteration -> i2) {
          w29 = each element of w20
          Multiply(i2, w28) -> w31
          Build Cluster(w31, w29) -> w32
          append w32 to w30
        }
        $Signal <- w30
        Property Node(instance in=w10) -> ("X"=w33, "Y"=w34, "Best Gaussian Fit"=w35, "Upper Bound"=w36, "Lower Bound"=w37)
        Build Index And Bundle Cluster Array(w33, w34) -> (out=w38)
        Build Index And Bundle Cluster Array(w33, w35) -> (out=w39)
        Build Index And Bundle Cluster Array(w33, w36) -> (out=w40)
        Build Index And Bundle Cluster Array(w33, w37) -> (out=w41)
        Build Array(w38, w39, w40, w41) -> w42
        $"Observed Data and Fitted Curve" <- w42
      }
    }
    next s1 = w4
    stop if FALSE
  }
