vi "Read TDMS Data.gviweb"   [G Web Development Software 22.3.0]
panel controls:
  "Matching File IDs": i32 = -1
  "Authentication Credentials": i32 = 2
  "username": string
  "server url": string
  "API Key": string
  "Hyperlink Control": string = "Read Write Messages.html"
  "Hyperlink Control_2": string = "Read Tags.html"
  "password": string
  "server url (for API Key)": string
panel indicators:
  "error out": error
  "Graph": f64[]
uses:
  NI::Skyline::Configuration::Open Configuration.gvi
  NI::Skyline::Configuration::Open Configuration API Key.gvi
  NI::Skyline::File::Create Filter (Name).gvi
  NI::Skyline::TDMReader::Query TDMS Files.gvi
  NI::Skyline::TDMReader::Get TDM File Metadata.gvi
  NI::Skyline::TDMReader::Open File.gvi
  NI::Skyline::TDMReader::Read Data (1Chan Double).gvi
diagram:
  # Open a connection to SystemLink Server or NI Web Server
  case ($"Authentication Credentials") {
    frame 0, Default {
      call "Open Configuration.gvi"(server url=$"server url", username=$username, password=$password) -> (configuration=w1, error out=w2)
    }
    frame 2 {
      # No credentials required when deploying to SystemLink Server or NI Web Server Web Application Hosting
      call "Open Configuration.gvi"() -> (configuration=w1, error out=w2)
    }
    frame 1 {
      call "Open Configuration API Key.gvi"(server url=$"server url (for API Key)", api key=$"API Key") -> (configuration=w1, error out=w2)
    }
  }
  # Find all TDMS files with "demo" in the filename
  call "Create Filter (Name).gvi"(name="demo", error in=w2) -> (filter out=w3, error out=w4)
  call "Query TDMS Files.gvi"(filter in=w3, error in=w4, configuration=w1) -> (tdm files=w5, error out=w6)
  for {
    w7 = each element of w5
    call "Get TDM File Metadata.gvi"(file in=w7) -> (id=w10, metadata=w11)
    Property Node(instance in=w11) -> ("name"=w12)
    append w10 to w8
    append w12 to w9
  }
  Property Node(instance in=reference to "Matching File IDs", "Items"=w9, error in=w6) -> (error out=w13)
  while {
    event (timeout = 100) {
      on "Matching File IDs" Value changed {
        Array Index(array=w8) -> (out0[$"Matching File IDs"]=w15)
        Is Empty String Or Path(string/path=w15) -> w16
        case (w16) {
          frame True {
            w14 = w13
          }
          frame False {
            # Open a TDMS file and read 500 points from first channel
            call "Open File.gvi"(file id=w15, error in=w13, configuration=w1) -> (tdm file=w17, error out=w18)
            call "Read Data (1Chan Double).gvi"(tdm file in=w17, error in=w18, count=500) -> (data=w19, error out=w14)
            $Graph <- w19
          }
        }
      }
      on "Timeout" {
        w14 = w13
      }
    }
    $"error out" <- w14
    stop if w14
  }
