vi "Function.gvi"   [LabVIEW NXG 4.0.0]
panel controls:
  "Matching File IDs": i32 = -1
panel indicators:
  "Graph": f64[]
  "error out": error
  "Graph_2": f64[]
uses:
  NI::Skyline::Configuration::Open Configuration.gvi
  NI::Skyline::Configuration::Open Configuration API Key.gvi
  NI::Skyline::File::Create Filter (Name).gvi
  NI::Skyline::TDMReader::Query TDMS Files.gvi
  NI::Skyline::TDMReader::Open File.gvi
  NI::Skyline::TDMReader::Read Data (1Chan Double).gvi
diagram:
  disable {
    frame Enabled {
      # Enable this diagram to connect to a SystemLink Server  on your network
      call "Open Configuration.gvi"(server url="http://test.systemlink.io", username="lvadmin", password="LabVIEW===") -> (configuration=w2, error out=w1)
    }
    frame Disabled {
      # Enter server URL and API key here
      #
      # Enable this diagram to run in LabVIEW or your own web server
      #
      # Disable this diagram before hosting in SystemLink Cloud
      # https://www.systemlinkcloud.com/webapphosting
      call "Open Configuration API Key.gvi"(server url="https://api.systemlinkcloud.com", api key="GHelw2Q2CWmHEgZLgsGdIWH7GBE-qMq3BkHwV54IVv") -> (configuration=w2, error out=w1)
    }
  }
  call "Create Filter (Name).gvi"(name="demo", error in=w1) -> (filter out=w3, error out=w4)
  call "Query TDMS Files.gvi"(filter in=w3, error in=w4, configuration=w2) -> (tdm files=w5)
  for {
    w6 = each element of w5
    Property Node(instance in=w6) -> ("file id"=w8)
    append w8 to w7
  }
  Property Node(instance in=reference to "Matching File IDs", "Items"=w7) -> (error out=w9)
  while {
    event {
      on "Matching File IDs" Value changed {
        Array Index(array=w7) -> (out0[$"Matching File IDs"]=w11)
        call "Open File.gvi"(file id=w11, error in=w9, configuration=w2) -> (tdm file=w12, error out=w13)
        call "Read Data (1Chan Double).gvi"(tdm file in=w12, error in=w13) -> (data=w14, error out=w10)
        $Graph <- w14
        $Graph_2 <- w14
      }
    }
    $"error out" <- w10
    stop if FALSE
  }
  Property Node(instance in=reference to "error out", "Value"=no error, error in=w1)
