vi "Deque Message.gvi"   [LabVIEW NXG 5.1.0]
inputs:
  "SystemLink Connection": T1
  "deque message": bool
  "error in": error
outputs:
  "SystemLink Connection out": T1
  "Message Out": "Message Cluster.gtype"
  "error out": error
types:
  "DataType.gtype" = enum{"Double", "I32", "String", "Boolean", "U64", "Timestamp"}
  "Tag.gtype" = cluster{"Path": string, "Datatype": "DataType.gtype", "Configuration": "Configuration.gtype"}
  "Message Session.gtype" = cluster{"Configuration": "Configuration.gtype", "token": string}
  T1 = cluster{"Tags": "Tag.gtype"[], "Message Topic": string, "Message Configuration": "Message Session.gtype"}
  "Message Cluster.gtype" = cluster{"Numeric": f64, "Switch": bool, "State": u16, "String": string}
uses:
  NI::Skyline::MessageHTTP::Read.gvi
diagram:
  # just output the cluster rather than each indicator
  s1 = uninitialised  # shift register
  while {
    Property Node(instance in=$"SystemLink Connection") -> ("Message Configuration"=w1, instance out=w2)
    case ($"deque message") {
      frame False, Default {
        w3 = $"error in"
        w4 = s1
      }
      frame True {
        call "Read.gvi"(message session in=w1, error in=$"error in") -> (message=w5, error out=w6)
        Is Empty String Or Path(string/path=w5) -> w7
        case (w7) {
          frame True {
            # If the read message times out an empty string is returned and therefore we cannot update the indicators
            w3 = w6
            w4 = s1
          }
          frame False {
            Unflatten From Json(JSON string=w5, error in (no error)=w6, type and defaults="Message Cluster.gtype" {all zero or empty}) -> (error out=w3, value=w4)
          }
        }
      }
    }
    next s1 = w4
    stop if TRUE
  }
  $"SystemLink Connection out" <- w2
  $"Message Out" <- s1
  $"error out" <- w3
