vi "Determine Next State.gvi"   [LabVIEW NXG 5.1.0]
inputs:
  "state in": "State.gtype" = "read-tags"
  "error in": error
  "connect": bool
outputs:
  "errror out": error
  "state out": "State.gtype"
types:
  "State.gtype" = enum{"read-tags", "write-tags", "write-message", "read-message", "error-no-systemlink", "initialize"}
diagram:
  w1 = "error-no-systemlink"  # State
  Select(s=$"error in", t=w1, f=$"state in") -> w2
  w3 = "initialize"  # State
  Select(s=$connect, t=w3, f=w2) -> w4
  $"state out" <- w4
  # Go to the state determined by the tab control.
  #
  # If there is an error go to the error state.
  #
  # If the user clicks Connect then go to the Initialize state regardless if there is an error.
  $"errror out" <- $"error in"
