vi "Initialize.gvi"   [LabVIEW NXG 3.0.0]
inputs:
  "server url": string
  "username": string
  "password": string
  "error in": error
  "AuthPicker": "AuthPicker.gtype" = "User Name + Password"
  "api key": string
  "tag paths": string[] = ["Skyline.Examples.DataServices.bool", "Skyline.Examples.DataServices.numeric", "Skyline.Examples.DataServices.string", "Skyline.Examples.Oven.Inside.Temp", "Skyline.Examples.Oven.Outside.Temp"]
outputs:
  "error out": error
  "SystemLink Connection": T1
types:
  "AuthPicker.gtype" = enum{"User Name + Password", "API Key"}
  "DataType.gtype" = enum{"Double", "I32", "String", "Boolean", "U64", "Timestamp"}
  "Tag.gtype" = cluster{"Path": string, "Datatype": "DataType.gtype", "Configuration": "Configuration.gtype"}
  "Message Session.gtype" = cluster{"Configuration": "Configuration.gtype", "token": string}
  T1 = cluster{"Tags": "Tag.gtype"[], "Message Topic": string, "Message Configuration": "Message Session.gtype"}
uses:
  NI::Skyline::Configuration::Open Configuration.gvi
  NI::Skyline::Configuration::Open Configuration API Key.gvi
  NI::Skyline::TagHTTP::Open Tag.gvi
  NI::Skyline::MessageHTTP::Open.gvi
  NI::Skyline::MessageHTTP::Subscribe.gvi
  subvis::Write Example Tags.gvi
diagram:
  case ($AuthPicker) {
    frame "User Name + Password", Default {
      call "Open Configuration.gvi"(server url=$"server url", username=$username, password=$password, error in=$"error in") -> (configuration=w1, error out=w2)
    }
    frame "API Key" {
      call "Open Configuration API Key.gvi"(server url="https://api.systemlinkcloud.com", api key=$"api key", error in=$"error in") -> (configuration=w1, error out=w2)
    }
  }
  Build Array("Boolean", "Double", "String", "Double", "Double") -> w3
  for {
    w4 = each element of $"tag paths"
    w5 = each element of w3
    call "Open Tag.gvi"(path=w4, data type=w5, error in=w2, configuration=w1) -> (tag out=w7, error out=w8)
    append w7 to w6
    stop if w8
  }
  call "Open.gvi"(error in=w8, configuration=w1) -> (message session out=w9, error out=w10)
  call "Subscribe.gvi"(message session=w9, topic="example.message.topic", error in=w10) -> (message session out=w11, error out=w12)
  Property Node(instance in=T1 {all zero or empty}, "Tags"=w6, "Message Topic"="example.message.topic", "Message Configuration"=w11) -> (instance out=w13)
  call "Write Example Tags.gvi"(SystemLink Connection=w13, SystemLink.Examples.DataServices.string_control="Example string", error in=w12) -> (SystemLink Connection out=w14, errror out=w15)
  $"SystemLink Connection" <- w14
  $"error out" <- w15
