vi "Publish Message.gvi"   [LabVIEW NXG 2.1.0]
inputs:
  "SystemLink Connection": T1
  "publish": bool
  "Message Cluster": "Message Cluster.gtype"
  "error": error
outputs:
  "SystemLink Connection out": T1
  "error out": error
types:
  "DataType.gtype" = enum{"Double", "Integer", "String"}
  "Tag.gtype" = cluster{"Path": string, "Datatype": "DataType.gtype", "Configuration": "Configuration.gtype"}
  "Message Session.gtype" = cluster{"Configuration": "Configuration.gtype", "token": string}
  T1 = cluster{"Tags": "Tag.gtype"[], "Message Topic": string, "Message Configuration": "Message Session.gtype"}
  "Message Cluster.gtype" = cluster{"Numeric": f64, "Switch": bool, "State": u16, "String": string}
uses:
  NI::Skyline::MessageHTTP::Publish.gvi
diagram:
  case ($error) {
    frame Error, Default {
      w1 = $"SystemLink Connection"
      w2 = $error
    }
    frame No Error {
      case ($publish) {
        frame False, Default {
          w2 = $error
          w1 = $"SystemLink Connection"
        }
        frame True {
          Property Node(instance in=$"SystemLink Connection") -> ("Message Configuration"=w3, "Message Topic"=w4, instance out=w1)
          Flatten To JSON(anything=$"Message Cluster", error in (no error)=$error) -> (JSON string=w5, error out=w6)
          call "Publish.gvi"(message session=w3, topic=w4, message=w5, error in=w6) -> (error out=w2)
        }
      }
    }
  }
  $"SystemLink Connection out" <- w1
  $"error out" <- w2
