vi "Queue FGV.gvi"   [LabVIEW NXG 3.1.0]
panel controls:
  "Queue FGV Mode": "Queue FGV Mode.gtype" = "Initialize"
  "Queue FGV Mode_2": "Queue FGV Mode.gtype" = "Initialize"
panel indicators:
  "Queued Messages Remaining": i32
types:
  "Queue FGV Mode.gtype" = enum{"Initialize", "Increment", "Decrement"}
diagram:
  w1 = $"Queue FGV Mode"
  s1 = 0  # shift register
  s2 = uninitialised  # shift register
  while {
    case (w1) {
      frame "Initialize" { }
      frame "Increment" {
        Increment(x=w2) -> w3
      }
      frame "Decrement" {
        Decrement(x=w4) -> w5
      }
    }
    next s1 = 0
    next s2 = _
    stop if TRUE
  }
  $"Queued Messages Remaining" <- s1
  w6 = $"Queue FGV Mode_2"
  while (after w6) {
    case (w7) {
      frame False, Default { }
      frame True { }
    }
    stop if TRUE
  }
