vi "Read Example Tags.gvi"   [G Web Development Software 22.3.0]
inputs:
  "Error": error
  "SystemLink Connection": T1
outputs:
  "Tag Grid": T3[]
  "error out": error
  "Numeric Tag Chart": T2
  "SystemLink Connection out": T1
types:
  "DataType.gtype" = enum{"Double", "I32", "String", "Boolean", "U64", "Timestamp"}
  "Tag.gtype" = cluster{"Path": string, "Workspace ID": string, "Datatype": "DataType.gtype", "Configuration": "Configuration.gtype"}
  "Message Session.gtype" = cluster{"Configuration": "Configuration.gtype", "token": string, "workspace id": string}
  T1 = cluster{"Tags": "Tag.gtype"[], "Message Topic": string, "Message Configuration": "Message Session.gtype"}
  T2 = cluster{"Element 0": f64, "Element 1": f64, "Element 2": f64, "Element 3": f64, "Element 4": f64, "Element 5": f64, "Element 6": f64, "Element 7": f64, "Element 8": f64}
  T3 = cluster{"Tag Paths": string, "Value": string, "Timestamp": string}
uses:
  NI::Skyline::TagHTTP::Query Tags.gvi
  NI::Skyline::TagHTTP::Open Tag.gvi
  NI::Skyline::TagHTTP::Read Tag (DBL).gvi
  NI::Skyline::TagHTTP::Read Tag (I32).gvi
  NI::Skyline::TagHTTP::Read Tag (String).gvi
  NI::Skyline::TagHTTP::Read Tag (Boolean).gvi
  NI::Skyline::TagHTTP::Read Tag (U64).gvi
  NI::Skyline::TagHTTP::Read Tag (Timestamp).gvi
diagram:
  Property Node(instance in=$"SystemLink Connection") -> ("Message Configuration:Configuration"=w1, instance out=w2)
  $"SystemLink Connection out" <- w2
  call "Query Tags.gvi"(paths=["SystemLink.Examples.*"], error in=$Error, configuration=w1) -> (tags=w3, error out=w4)
  for {
    w5 = each element of w3
    Property Node(instance in=w5) -> ("Path"=w8, "Datatype"=w9)
    call "Open Tag.gvi"(path=w8, data type=w9, error in=w4, configuration=w1) -> (tag=w10, error out=w11)
    case (w9) {
      frame "Double" {
        call "Read Tag (DBL).gvi"(tag in=w10, error in=w11) -> (value=w15, time stamp=w13, error out=w16)
        Format Into String(errIn=w16, w15) -> (outString=w12, errOut=w14)
      }
      frame "I32" {
        call "Read Tag (I32).gvi"(tag in=w10, error in=w11) -> (value=w17, time stamp=w13, error out=w18)
        Format Into String(errIn=w18, w17) -> (outString=w12, errOut=w14)
        w15 = default
      }
      frame "String" {
        call "Read Tag (String).gvi"(tag in=w10, error in=w11) -> (value=w19, time stamp=w13, error out=w20)
        Format Into String(errIn=w20, w19) -> (outString=w12, errOut=w14)
        w15 = default
      }
      frame "Boolean" {
        call "Read Tag (Boolean).gvi"(tag in=w10, error in=w11) -> (value=w21, time stamp=w13, error out=w14)
        Select(s=w21, t="True", f="False") -> w12
        w15 = default
      }
      frame "U64" {
        call "Read Tag (U64).gvi"(tag in=w10, error in=w11) -> (value=w22, time stamp=w13, error out=w23)
        Format Into String(errIn=w23, w22) -> (outString=w12, errOut=w14)
        w15 = default
      }
      frame "Timestamp" {
        call "Read Tag (Timestamp).gvi"(tag in=w10, error in=w11) -> (value=w24, time stamp=w13, error out=w25)
        Format Into String(errIn=w25, w24) -> (outString=w12, errOut=w14)
        w15 = default
      }
    }
    Is Not A Number Or Path Or Refnum(number=w15) -> w26
    Not(x=w26) -> w27
    Format Into String(errIn=w14, w13) -> (outString=w28, errOut=w29)
    Property Node(instance in=T3 {all zero or empty}, "Tag Paths"=w8, "Value"=w12, "Timestamp"=w28) -> (instance out=w30)
    append w30 to w6
    append w15 to w7 if w27
  }
  Array To Cluster[NumberOfClusterElements=9](array=w7) -> (cluster=w31)
  $"Numeric Tag Chart" <- w31
  $"Tag Grid" <- w6
  $"error out" <- w29
