vi "Update Remaining Queue Indicator.gvi"   [LabVIEW NXG 3.1.0]
inputs:
  "SystemLink Connection": T1
  "Queue FGV Mode": "Queue FGV Mode.gtype" = "Initialize"
  "error in": error
outputs:
  "SystemLink Connection out": T1
  "Queued Messages Remaining": i32
  "error out": error
  "Output": i32
panel controls:
  "Numeric Constant": i32
types:
  "DataType.gtype" = enum{"Double", "I32", "String", "Boolean", "U64", "Timestamp"}
  "Tag.gtype" = cluster{"Path": string, "Datatype": "DataType.gtype", "Configuration": "Configuration.gtype"}
  "Message Session.gtype" = cluster{"Configuration": "Configuration.gtype", "token": string}
  T1 = cluster{"Tags": "Tag.gtype"[], "Message Topic": string, "Message Configuration": "Message Session.gtype"}
  "Queue FGV Mode.gtype" = enum{"Initialize", "Update"}
uses:
  NI::Skyline::MessageHTTP::Get Queue Size Bytes.gvi
diagram:
  disable {
    frame Disabled {
      w2 = $"Numeric Constant"
    }
    frame Enabled {
      Property Node(instance in=$"SystemLink Connection") -> ("Message Configuration"=w4, instance out=w1)
      call "Get Queue Size Bytes.gvi"(message session=w4, error in=$"error in") -> (queue size bytes=w2, error out=w3)
    }
  }
  $"SystemLink Connection out" <- w1
  s1 = uninitialised  # shift register
  s2 = uninitialised  # shift register
  while {
    case ($"Queue FGV Mode") {
      frame "Initialize" {
        w5 = 0
      }
      frame "Update", Default {
        Subtract(x=w2, y=s2) -> w6
        case (w6) {
          frame 1.. {
            Increment(x=s1) -> w5
          }
          frame ..-1 {
            Decrement(x=s1) -> w5
          }
          frame 0 {
            w5 = s1
          }
        }
      }
    }
    next s1 = w5
    next s2 = w2
    stop if TRUE
  }
  $"Queued Messages Remaining" <- s1
  $Output <- w2
  $"error out" <- w3
