vi "Write Example Tags.gvi"   [LabVIEW NXG 3.1.0]
inputs:
  "SystemLink.Examples.bool_control": bool
  "error in": error
  "SystemLink Connection": T1
  "SystemLink.Examples.numeric_control": f64
  "SystemLink.Examples.string_control": string
outputs:
  "errror out": error
  "SystemLink Connection out": T1
types:
  "DataType.gtype" = enum{"Double", "I32", "String", "Boolean", "U64", "Timestamp"}
  "Tag.gtype" = cluster{"Path": string, "Datatype": "DataType.gtype", "Configuration": "Configuration.gtype"}
  "Message Session.gtype" = cluster{"Configuration": "Configuration.gtype", "token": string}
  T1 = cluster{"Tags": "Tag.gtype"[], "Message Topic": string, "Message Configuration": "Message Session.gtype"}
uses:
  NI::Skyline::TagHTTP::Write Tag (Boolean).gvi
  NI::Skyline::TagHTTP::Write Tag (DBL).gvi
  NI::Skyline::TagHTTP::Write Tag (String).gvi
diagram:
  $"SystemLink Connection out" <- $"SystemLink Connection"
  Property Node(instance in=$"SystemLink Connection") -> ("Tags"=w1)
  Array Index(array=w1) -> (out0[_]=w2, out1[_]=w3, out2[_]=w4)
  call "Write Tag (Boolean).gvi"(tag in=w2, value=$"SystemLink.Examples.bool_control", error in=$"error in") -> (error out=w5)
  call "Write Tag (DBL).gvi"(tag in=w3, value=$"SystemLink.Examples.numeric_control", error in=$"error in") -> (error out=w6)
  call "Write Tag (String).gvi"(tag in=w4, value=$"SystemLink.Examples.string_control", error in=$"error in") -> (error out=w7)
  Merge Errors(w5, w6, w7) -> (error out=w8)
  $"errror out" <- w8
