vi "Read Example Tags.gvi"   [LabVIEW NXG 3.0.0]
inputs:
  "error in": error
  "SystemLink Connection": T1
outputs:
  "error out": error
  "SystemLink.Examples.DataServices.numeric_slider-indicator": f64
  "SystemLink.Examples.DataServices.string_indicator": string
  "SystemLink.Examples.DataServices.bool-indicator": bool
  "SystemLink Connection out": T1
  "SystemLink.Examples.Oven.Outside.Temp-tank-indicator": f64
  "SystemLink.Examples.Oven.Inside.Temp-tank-indicator": f64
types:
  "DataType.gtype" = enum{"Double", "I32", "String", "Boolean", "U64", "Timestamp"}
  "Tag.gtype" = cluster{"Path": string, "Datatype": "DataType.gtype", "Configuration": "Configuration.gtype"}
  "Message Session.gtype" = cluster{"Configuration": "Configuration.gtype", "token": string}
  T1 = cluster{"Tags": "Tag.gtype"[], "Message Topic": string, "Message Configuration": "Message Session.gtype"}
uses:
  NI::Skyline::TagHTTP::Read Tag (Boolean).gvi
  NI::Skyline::TagHTTP::Read Tag (DBL).gvi
  NI::Skyline::TagHTTP::Read Tag (String).gvi
  NI::Skyline::TagHTTP::Multi Read.gvi
diagram:
  $"SystemLink Connection out" <- $"SystemLink Connection"
  Property Node(instance in=$"SystemLink Connection") -> ("Tags"=w1)
  case ($"error in") {
    frame Error, Default {
      w2 = default
      w3 = default
      w4 = default
      w5 = $"error in"
      w6 = default
      w7 = default
    }
    frame No Error {
      disable {
        frame Enabled {
          Array Index(array=w1) -> (out0[_]=w8, out1[_]=w9, out2[_]=w10, out3[_]=w11, out4[_]=w12)
          call "Read Tag (Boolean).gvi"(tag in=w8, error in=$"error in") -> (value=w2, error out=w13)
          call "Read Tag (DBL).gvi"(tag in=w9, error in=$"error in") -> (value=w3, error out=w14)
          call "Read Tag (String).gvi"(tag in=w10, error in=$"error in") -> (value=w4, error out=w15)
          call "Read Tag (DBL).gvi"(tag in=w11, error in=$"error in") -> (value=w6, error out=w16)
          call "Read Tag (DBL).gvi"(tag in=w12, error in=$"error in") -> (value=w7, error out=w17)
          Merge Errors(w13, w14, w15, w16, w17) -> (error out=w5)
        }
        frame Disabled {
          call "Multi Read.gvi"(tags in=w1, error in=$"error in") -> (tag clusters=w18, error out=w19)
          Array Index(array=w18) -> (out0[_]=w20, out1[_]=w21, out2[_]=w22, out3[_]=w23, out4[_]=w24)
          Property Node(instance in=w20) -> ("Value"=w25)
          Scan From String(inputString=w25, errIn=w19, default=FALSE) -> (errOut=w26, out0=w2)
          Property Node(instance in=w21) -> ("Value"=w27)
          Scan From String(inputString=w27, errIn=w19) -> (errOut=w28, out0=w3)
          Property Node(instance in=w23) -> ("Value"=w29)
          Scan From String(inputString=w29, errIn=w19) -> (errOut=w30, out0=w6)
          Property Node(instance in=w24) -> ("Value"=w31)
          Scan From String(inputString=w31, errIn=w19) -> (errOut=w32, out0=w7)
          Merge Errors(w26, w28, w30, w32) -> (error out=w5)
          Property Node(instance in=w22) -> ("Value"=w4)
        }
      }
    }
  }
  $"SystemLink.Examples.DataServices.bool-indicator" <- w2
  $"error out" <- w5
  $"SystemLink.Examples.DataServices.numeric_slider-indicator" <- w3
  $"SystemLink.Examples.DataServices.string_indicator" <- w4
  $"SystemLink.Examples.Oven.Inside.Temp-tank-indicator" <- w6
  $"SystemLink.Examples.Oven.Outside.Temp-tank-indicator" <- w7
