vi "Write Example Tags.gvi"   [LabVIEW NXG 3.0.0]
inputs:
  "SystemLink.Examples.DataServices.bool-control": bool
  "error in": error
  "SystemLink Connection": T1
  "SystemLink.Examples.DataServices.numeric-slider-control": f64
  "SystemLink.Examples.DataServices.string-control": string
  "SystemLink.Examples.Oven.Outside.Temp-slider-control": f64
  "SystemLink.Examples.Oven.Inside.Temp-slider-control": f64
outputs:
  "errror out": error
  "SystemLink Connection out": T1
types:
  "DataType.gtype" = enum{"Double", "I32", "String", "Boolean", "U64", "Timestamp"}
  "Tag.gtype" = cluster{"Path": string, "Datatype": "DataType.gtype", "Configuration": "Configuration.gtype"}
  "Message Session.gtype" = cluster{"Configuration": "Configuration.gtype", "token": string}
  T1 = cluster{"Tags": "Tag.gtype"[], "Message Topic": string, "Message Configuration": "Message Session.gtype"}
  "Client Handle.gtype" = u32
  "Configuration.gtype" = cluster{"Server URL": string, "Session": "Client Handle.gtype"}
  "Tag Value Cluster.gtype" = cluster{"Path": string, "Data Type": "DataType.gtype", "Value": string, "Time Stamp": timestamp}
  "Tag Cluster HTTP.gtype" = cluster{"Configuration": "Configuration.gtype", "Tag Cluster": "Tag Value Cluster.gtype"}
uses:
  NI::Skyline::TagHTTP::Write Tag (Boolean).gvi
  NI::Skyline::TagHTTP::Write Tag (DBL).gvi
  NI::Skyline::TagHTTP::Write Tag (String).gvi
  NI::Skyline::TagHTTP::Multi Write.gvi
diagram:
  $"SystemLink Connection out" <- $"SystemLink Connection"
  Property Node(instance in=$"SystemLink Connection") -> ("Tags"=w1)
  case ($"error in") {
    frame Error, Default {
      w2 = $"error in"
    }
    frame No Error {
      disable {
        frame Enabled {
          Array Index(array=w1) -> (out0[_]=w3, out1[_]=w4, out2[_]=w5, out3[_]=w6, out4[_]=w7)
          call "Write Tag (Boolean).gvi"(tag in=w3, value=$"SystemLink.Examples.DataServices.bool-control", error in=$"error in") -> (error out=w8)
          call "Write Tag (DBL).gvi"(tag in=w4, value=$"SystemLink.Examples.DataServices.numeric-slider-control", error in=$"error in") -> (error out=w9)
          call "Write Tag (String).gvi"(tag in=w5, value=$"SystemLink.Examples.DataServices.string-control", error in=$"error in") -> (error out=w10)
          call "Write Tag (DBL).gvi"(tag in=w6, value=$"SystemLink.Examples.Oven.Inside.Temp-slider-control", error in=$"error in") -> (error out=w11)
          call "Write Tag (DBL).gvi"(tag in=w7, value=$"SystemLink.Examples.Oven.Outside.Temp-slider-control", error in=$"error in") -> (error out=w12)
          Merge Errors(w8, w9, w10, w11, w12) -> (error out=w2)
        }
        frame Disabled {
          Format Into String(errIn=$"error in", $"SystemLink.Examples.DataServices.bool-control") -> (outString=w13, errOut=w14)
          Format Into String(errIn=$"error in", $"SystemLink.Examples.DataServices.numeric-slider-control") -> (outString=w15, errOut=w16)
          Format Into String(errIn=$"error in", $"SystemLink.Examples.Oven.Inside.Temp-slider-control") -> (outString=w17, errOut=w18)
          Format Into String(errIn=$"error in", $"SystemLink.Examples.Oven.Outside.Temp-slider-control") -> (outString=w19, errOut=w20)
          Merge Errors(w14, w16, w18, w20) -> (error out=w21)
          Build Array(w13, w15, $"SystemLink.Examples.DataServices.string-control", w17, w19) -> w22
          for {
            w23 = each element of w1
            w24 = each element of w22
            Property Node(instance in=w23) -> ("Configuration"=w26, "Path"=w27, "Datatype"=w28)
            Property Node(instance in="Tag Cluster HTTP.gtype" {all zero or empty}, "Configuration"=w26, "Tag Cluster:Path"=w27, "Tag Cluster:Data Type"=w28, "Tag Cluster:Value"=w24) -> (instance out=w29)
            append w29 to w25
          }
          # Working around bug where multi write has an error in dependency.
          call "Multi Write.gvi"(tag clusters=w25, error in=w21) -> (error out=w2)
        }
      }
    }
  }
  $"errror out" <- w2
