vi "Check If Empty.gviweb"   [LabVIEW NXG 3.1.0]
inputs:
  "Message In": string
  "Send": bool
outputs:
  "Send?": bool
  "Message Out": string
diagram:
  $"Message Out" <- $"Message In"
  Is Empty String Or Path(string/path=$"Message In") -> w1
  Not(x=w1) -> w2
  Logical And(w2, $Send) -> w3
  $"Send?" <- w3
