vi "Format Received Message.gviweb"   [LabVIEW NXG 3.1.0]
inputs:
  "Chat In": string
  "lastMessage": string
outputs:
  "Chat Out": string
uses:
  Chat::subvis::Get Time String.gviweb
diagram:
  Is Empty String Or Path(string/path=$lastMessage) -> w1
  case (w1) {
    frame True {
      w2 = $"Chat In"
    }
    frame False {
      call "Get Time String.gviweb"() -> (TimeString=w3)
      Concatenate Strings($"Chat In", w3, " EchoServer responded: ", $lastMessage, "\r\n") -> w2
    }
  }
  $"Chat Out" <- w2
