vi "Main.gviweb"   [LabVIEW NXG 3.1.0]
# This example uses the JavaScript Library Interface (JSLI) to connect to a WebSocket Echo Server.
panel controls:
  "Hyperlink Control": string = "https://github.com/ni/webvi-examples/tree/master/ConnectWebVIToWebSocketEchoServer"
  "Message": string
  "Send": bool
  "Disconnect": bool
  "WebSocket URL": string = "ws://echo.websocket.org/"
  "Connect": bool
panel indicators:
  "Messages": string
  "Close Error": error
uses:
  NI::WebSockets::Open WebSocket.gvi
  Chat::subvis::Check If Empty.gviweb
  Chat::subvis::Format Sent Message.gviweb
  NI::WebSockets::Write String.gvi
  NI::WebSockets::Read String.gvi
  NI::G Core::Error::Read Error Code.gvi
  Chat::subvis::Format Received Message.gviweb
  NI::WebSockets::Close WebSocket.gvi
diagram:
  $Messages <- ""
  Concatenate Strings("Welcome to EchoServer Chat!", "\r\n") -> w1
  # 1. Connects to the echo server.
  while {
    w2 = $"WebSocket URL"
    stop if $Connect
  }
  call "Open WebSocket.gvi"(url=w2) -> (websocket session out=w3, error out=w4)
  # 4. Disconnects from
  # the echo server.
  s1 = w1  # shift register
  while {
    $Messages <- s1
    call "Check If Empty.gviweb"(Message In=$Message, Send=$Send) -> (Message Out=w5, Send?=w6)
    case (w6) {
      frame False, Default {
        w7 = s1
        w8 = w4
        w9 = w3
      }
      frame True {
        call "Format Sent Message.gviweb"(Chat=s1, Message=w5) -> (Formatted Message=w7)
        $Message <- ""
        call "Write String.gvi"(websocket session in=w3, string message=w5, error in=w4) -> (websocket session out=w9, error out=w8)
      }
    }
    call "Read String.gvi"(websocket session in=w9, timeout=0.05, error in=w8) -> (websocket session out=w10, string response=w11, error out=w12)
    # 3. Polls for the latest
    # message every iteration.
    # If read doesn't time out
    # indicating no message
    # available) then it will
    # display the new message.
    call "Read Error Code.gvi"(error in=w12) -> (code=w13)
    case (w13) {
      frame 56 {
        w17 = no error  # Error Constant
        w14 = w7
        w15 = w10
        w16 = w17
      }
      frame 0, Default {
        call "Format Received Message.gviweb"(Chat In=w7, lastMessage=w11) -> (Chat Out=w14)
        w15 = w10
        w16 = w12
      }
    }
    # 2. Sends, and displays a
    # message every time the
    # user clicks the Send button.
    Wait(time to wait=50)
    next s1 = w14
    stop if $Disconnect
  }
  call "Close WebSocket.gvi"(websocket session in=w15, error in=w16) -> (error out=w18)
  $"Close Error" <- w18
