vi "index.gviweb"   [G Web Development Software 21.0.0]
panel controls:
  "Hyperlink Control": string = "https://github.com/ni/webvi-examples"
  "Message": string
  "Send": bool
  "Disconnect": bool
  "WebSocket Server Url": string = "wss://echo.websocket.org/"
  "Connect": bool
  "Messages": T1[]
panel indicators:
  "banner": string
types:
  T1 = cluster{"Source": string, "Time": string, "Message": string}
uses:
  WebApp::support::Record Message.gviweb
  NI::WebSockets::Open WebSocket.gvi
  NI::WebSockets::Write String.gvi
  NI::WebSockets::Close WebSocket.gvi
  NI::G Core::Error::Is Error.gvi
  WebApp::support::Example Display Error.gviweb
  NI::WebSockets::Read String.gvi
diagram:
  call "Record Message.gviweb"(Reset?=TRUE, Messages reference=reference to "Messages") -> (Error Out=w1)
  # 1. Connect to the WebSocket echo server.
  event {
    on "Connect" Value changed {
      call "Record Message.gviweb"(Message="Connecting...", Direction="Informational", Error In=w1) -> (Error Out=w4)
      call "Open WebSocket.gvi"(url=$"WebSocket Server Url", error in=w4) -> (websocket session out=w3, error out=w5)
      call "Record Message.gviweb"(Message="Connected", Direction="Informational", Error In=w5) -> (Error Out=w2)
    }
  }
  # 2. Send a message to the WebSocket server or disconnect by closing the connection.
  s1 = w2  # shift register
  while {
    event (timeout = 1) {
      on "Send" Value changed {
        call "Write String.gvi"(websocket session in=w3, string message=$Message, error in=s1) -> (error out=w8)
        call "Record Message.gviweb"(Message=$Message, Direction="Outbound", Error In=w8) -> (Error Out=w6)
        w7 = FALSE
      }
      on "Disconnect" Value changed {
        call "Close WebSocket.gvi"(websocket session in=w3, error in=s1) -> (error out=w6)
        w7 = $Disconnect
      }
      on "Timeout" {
        w6 = s1
        w7 = default
      }
    }
    call "Is Error.gvi"(error in=w6) -> (error?=w9)
    Logical Or(w9, w7) -> w10
    next s1 = w6
    stop if w10
  }
  sequence {
    frame 0 {
      call "Example Display Error.gviweb"(error in=s1)
      call "Record Message.gviweb"(Message="Disconnected", Direction="Informational")
    }
  }
  # 3. Wait for a message from the server or for the connection to close / error.
  while {
    call "Read String.gvi"(websocket session in=w3, error in=w2) -> (string response=w11, error out=w12)
    call "Record Message.gviweb"(Message=w11, Direction="Inbound", Error In=w12) -> (Error Out=w13)
    stop if w13
  }
