vi "Format Log to Console.gviweb"   [LabVIEW NXG 3.1.0]
inputs:
  "Input": string
  "error in": error
outputs:
  "error out": error
uses:
  WebSocket Client Library::WebSocket Client.jsli::Console Log
diagram:
  Concatenate Strings("Sent Message: ", $Input) -> w1
  call "Console Log"(message=w1, error in=$"error in") -> (error out=w2)
  $"error out" <- w2
