vi "Main.gviweb"   [LabVIEW Platform Developer Preview 0.1.0]
panel controls:
  "Multiplier": bool
  "Slider": f64
  "Power Button": bool
panel indicators:
  "Start Tank": f64
  "Tank": f64
  "Graph": f64[][]
  "Chart": f64
  "Alter": bool
  "Progress Bar": f64
  "LED": bool
  "Numeric_2": f64
  "Numeric": f64
  "URL Image": string
diagram:
  while (iteration -> i1) {
    Divide(x=i1, y=1000) -> w1
    Quotient And Remainder(x=w1, y=10) -> (floor(x/y)=w2, x-y*floor(x/y)=w3)
    $Numeric_2 <- w3
    Random Number() -> (number (0 to 1)=w4)
    Is Greater(x=w4, y=0.5) -> w5
    $Alter <- w5
    Not(x=w5) -> w6
    $LED <- w6
    Add($Slider, w2) -> w7
    $Tank <- w7
    Multiply(10, w4) -> w8
    Multiply(w7, w8) -> w9
    case ($"Power Button") {
      frame False, Default { }
      frame True {
        $"Start Tank" <- w9
      }
    }
    $"Progress Bar" <- w7
    Wait(time to wait=50)
    for (N = 5) {
      for (N = 50) {
        Random Number() -> (number (0 to 1)=w12)
        $Numeric <- w12
        Select(s=$Multiplier, t=100, f=1) -> w13
        Multiply(w12, w13) -> w14
        $Chart <- w14
        append w14 to w11
      }
      append w11 to w10
    }
    $Graph <- w10
    stop if FALSE
  }
