vi "index.gviweb"   [G Web Development Software 21.0.0]
panel controls:
  "Multiplier": bool = TRUE
  "Main Fill Level": f64 = 1.58653846154
  "Power Button": bool = TRUE
  "Hyperlink Control": string = "https://github.com/ni/webvi-examples"
  "Power Button_2": bool = TRUE
panel indicators:
  "Start Filling 1": f64
  "Graph": f64[][]
  "Fill Level": f64
  "Residuals Mean": f64
  "% Completed": f64
  "Start Filling 2": f64
diagram:
  while (iteration -> i1) {
    To Double Precision Float(number=i1) -> w1
    Quotient And Remainder(x=w1, y=100) -> (floor(x/y)=w2, x-y*floor(x/y)=w3)
    Add($"Main Fill Level", w2) -> w4
    Random Number() -> (number (0 to 1)=w5)
    Multiply(w5, 10) -> w6
    Multiply(w6, w4) -> w7
    case ($"Power Button") {
      frame False, Default { }
      frame True {
        $"Start Filling 1" <- w7
        $"Fill Level" <- w4
      }
    }
    case ($"Power Button_2") {
      frame False, Default { }
      frame True {
        $"Start Filling 2" <- w7
      }
    }
    $"% Completed" <- w3
    for (N = 5) {
      for (N = 50) {
        Random Number() -> (number (0 to 1)=w10)
        $"Residuals Mean" <- w10
        Select(s=$Multiplier, t=100, f=1) -> w11
        Multiply(w10, w11) -> w12
        append w12 to w9
      }
      append w9 to w8
    }
    $Graph <- w8
    Wait(time to wait=50)
    stop if FALSE
  }
