vi "Main.gviweb"   [LabVIEW NXG 2.0.0]
panel controls:
  "Slider": f64
  "Slider_2": f64
  "Numeric": f64 = 879478
  "Numeric_2": c128 = 103+4i
  "Slider_3": f64
  "Slider_4": f64
panel indicators:
  "Tank": f64
  "Graph": f64[][]
  "Gauge": f64
  "Radial Progress Bar": f64
  "Data Grid": T1[]
types:
  T1 = cluster{"Testers": string, "Test Progress": f64, "Test Status": bool}
diagram:
  while {
    Wait(time to wait=150)
    $Gauge <- $Slider_3
    $"Radial Progress Bar" <- $Slider_4
    Add($Slider, $Slider_2) -> w1
    $Tank <- w1
    stop if FALSE
  }
  w2 = [{"Testers"="e-DUT-13A", "Test Progress"=96, "Test Status"=TRUE}, {"Testers"="f-DUT-46C", "Test Progress"=33, "Test Status"=FALSE}, {"Testers"="g-DUT-55k", "Test Progress"=75, "Test Status"=TRUE}, {"Testers"="g-DUT-87H", "Test Progress"=5, "Test Status"=TRUE}, {"Testers"="g-DUT-MAB", "Test Progress"=100, "Test Status"=FALSE}]
  $"Data Grid" <- w2
  while {
    for (N = 100) (iteration -> i1) {
      Divide(x=i1, y=10) -> w5
      Sine(x=w5) -> w6
      Random Number() -> (number (0 to 1)=w7)
      Add(w6, w7) -> w8
      Random Number() -> (number (0 to 1)=w9)
      Divide(x=w9, y=10) -> w10
      Add(w10, 1) -> w11
      append w8 to w3
      append w11 to w4
    }
    Build Array(w3, w4) -> w12
    $Graph <- w12
    Wait(time to wait=16)
    stop if FALSE
  }
