vi "index.gviweb"   [G Web Development Software 21.0.0]
panel controls:
  "Hyperlink Control": string = "https://github.com/ni/webvi-examples"
panel indicators:
  "Web Cam": string
  "Windspeed": f64
  "Wind Direction": f64
  "banner": string
diagram:
  while {
    Wait(time to wait=250)
    Random Number() -> (number (0 to 1)=w1)
    Divide(x=w1, y=11) -> w2
    Add(w2, 11) -> w3
    $Windspeed <- w3
    Random Number() -> (number (0 to 1)=w4)
    Add(w4, 50) -> w5
    $"Wind Direction" <- w5
    stop if FALSE
  }
