vi "Compare Add.gviweb"   [LabVIEW NXG 3.0.0]
inputs:
  "X": u32
  "Y": u32
outputs:
  "Add VI": u32
  "Add JSLI (Decimal)": u32
  "Add JSLI": bool[]
  "Add JSLI Error": error
uses:
  Calculator::Calculator Functions.jsli::Add JSLI
diagram:
  Add($X, $Y) -> w1
  $"Add VI" <- w1
  call "Add JSLI"(X=$X, Y=$Y, error in=no error) -> (Z=w2, error out=w3)
  $"Add JSLI (Decimal)" <- w2
  Number To Boolean Array(number=w2) -> (Boolean array=w4)
  $"Add JSLI" <- w4
  $"Add JSLI Error" <- w3
