vi "Compare Max.gviweb"   [LabVIEW NXG 3.0.0]
inputs:
  "X": u32
  "Y": u32
outputs:
  "Max VI": u32
  "Max JSLI (Decimal)": u32
  "Max JSLI": bool[]
  "Max JSLI Error": error
uses:
  Calculator::Max.jsli::MaxFromJSLI
diagram:
  Max And Min(x=$X, y=$Y) -> (max(x,y)=w1: u32)
  $"Max VI" <- w1
  call "MaxFromJSLI"(X=$X, Y=$Y, error in=no error) -> (return=w2, error out=w3)
  $"Max JSLI (Decimal)" <- w2
  Number To Boolean Array(number=w2) -> (Boolean array=w4)
  $"Max JSLI" <- w4
  $"Max JSLI Error" <- w3
