vi "main.gviweb"   [LabVIEW NXG 3.0.0]
panel controls:
  "X (Binary)": bool[]
  "Y (Binary)": bool[]
  "GitHub Hyperlink": string = "https://github.com/ni/webvi-examples"
  "Log": bool
panel indicators:
  "X (Decimal)": u32
  "Y (Decimal)": u32
  "Add (Built-in)": u32
  "Add JSLI": bool[]
  "Add (JSLI)": u32
  "Add JSLI Error": error
  "Multiply (Built-in)": u32
  "Multiply JSLI": bool[]
  "Multiply (JSLI)": u32
  "Multiply JSLI Error": error
  "Log Error": error
uses:
  Calculator::subvis::Compare Multiply.gviweb
  Calculator::subvis::Compare Add.gviweb
  Calculator::subvis::Format Console Log.gviweb
  Calculator::Calculator Functions.jsli::Log to Console
diagram:
  # To reference external JavaScript files, you must add script tags to the HTML source panel.
  # This example uses the following script tags.
  #
  # <script src="Add.js" type="application/javascript"></script>
  # <script src="Multiply.js" type="application/javascript"></script>
  while {
    Wait(time to wait=200)
    Boolean Array To Number(Boolean array=$"X (Binary)") -> (number=w1)
    $"X (Decimal)" <- w1
    Boolean Array To Number(Boolean array=$"Y (Binary)") -> (number=w2)
    call "Compare Multiply.gviweb"(X=w1, Y=w2) -> (Multi JSLI (Decimal)=w3, Multi VI=w4, Multiply JSLI=w5, Multiply JSLI Error=w6)
    call "Compare Add.gviweb"(X=w1, Y=w2) -> (Add JSLI (Decimal)=w7, Add VI=w8, Add JSLI=w9, Add JSLI Error=w10)
    case ($Log) {
      frame False, Default { }
      frame True {
        call "Format Console Log.gviweb"(Add JSLI=w7, Multi JSLI=w3) -> (Formatted String=w11)
        call "Log to Console"(arg=w11, error in=no error) -> (error out=w12)
        $"Log Error" <- w12
      }
    }
    $"Y (Decimal)" <- w2
    $"Add (JSLI)" <- w7
    $"Add (Built-in)" <- w8
    $"Add JSLI" <- w9
    $"Add JSLI Error" <- w10
    $"Multiply (JSLI)" <- w3
    $"Multiply (Built-in)" <- w4
    $"Multiply JSLI" <- w5
    # For simple use cases, see Multiply.js.
    # For more complex use cases, NI recommends using the conventions shown in Add.js.
    $"Multiply JSLI Error" <- w6
    stop if FALSE
  }
