vi "main.gviweb"   [LabVIEW NXG 3.0.0]
panel controls:
  "Message": string
  "WebSocket URL": string = "ws://echo.websocket.org/"
  "Send": bool
  "Disconnect": bool
  "Connect": bool
  "Hyperlink Control": string = "https://github.com/ni/webvi-examples/"
panel indicators:
  "Chat": string
  "Send error": error
  "Close error": error
  "Received error": error
uses:
  Chat::WebSocket Client.jsli::OpenWebSocket
  Chat::subvis::Format Sent Message.gviweb
  Chat::subvis::Format Log to Console.gviweb
  Chat::WebSocket Client.jsli::SendMessage
  Chat::WebSocket Client.jsli::CheckMessage
  Chat::subvis::Format Received Message.gviweb
  Chat::WebSocket Client.jsli::CloseWebSocket
diagram:
  Concatenate Strings("Welcome to EchoServer Chat!", "\r\n") -> w1
  # 1. Connects to the echo server.
  while {
    w2 = $"WebSocket URL"
    stop if $Connect
  }
  call "OpenWebSocket"(wsURI=w2) -> (error out=w3)
  # To reference external JavaScript files, you must add script tags to the HTML source panel.
  # This example uses the following script tags.
  #
  # <script src="Chat JS Functions.js" type="application/javascript"></script>
  # 5. Disconnects from the
  # echo server.
  s1 = w1  # shift register
  while {
    Wait(time to wait=50)
    # 2. Sends and displays a
    # message every time the
    # user clicks the Send button.
    # 3. Polls for the latest
    # message every iteration.
    case ($Send) {
      frame False, Default {
        w4 = s1
      }
      frame True {
        call "Format Sent Message.gviweb"(Chat=s1, Message=$Message) -> (Formatted Message=w4)
        call "Format Log to Console.gviweb"(Input=$Message)
        call "SendMessage"(message=$Message, error in=w3) -> (error out=w5)
        $"Send error" <- w5
      }
    }
    call "CheckMessage"(error in=w3) -> (lastMessage=w6, error out=w7)
    call "Format Received Message.gviweb"(Chat In=w4, lastMessage=w6) -> (Chat Out=w8)
    $Chat <- w8
    $"Received error" <- w7
    # 4. Displays only if the
    # latest message is not
    # an empty string.
    next s1 = w8
    stop if $Disconnect
  }
  call "CloseWebSocket"(error in=no error) -> (error out=w9)
  $"Close error" <- w9
