vi "Format Log to Console.gviweb"   [LabVIEW NXG 3.0.0]
inputs:
  "Input": string
uses:
  Chat::WebSocket Client.jsli::Console Log
diagram:
  Concatenate Strings("Sent: ", $Input) -> w1
  call "Console Log"(message=w1)
