vi "Format Sent Message.gviweb"   [LabVIEW NXG 3.0.0]
inputs:
  "Chat": string
  "Message": string
outputs:
  "Formatted Message": string
uses:
  Chat::subvis::Get Time String.gviweb
diagram:
  call "Get Time String.gviweb"() -> (TimeString=w1)
  Concatenate Strings($Chat, w1, " You sent: ", $Message, "\r\n") -> w2
  $"Formatted Message" <- w2
