vi "Main.gviweb"   [LabVIEW NXG 3.0.0]
panel controls:
  "Message": string
  "WebSocket URL": string = "ws://echo.websocket.org/"
  "Send": bool
  "Disconnect": bool
  "Connect": bool
  "Hyperlink Control": string = "https://github.com/ni/webvi-examples/"
panel indicators:
  "Messages": string
  "Close Error": error
  "Send/Receive Error": error
uses:
  Chat::WebSocket Client.jsli::OpenWebSocket
  Chat::subvis::Format Sent Message.gviweb
  Chat::WebSocket Client.jsli::SendMessage
  Chat::subvis::Format Log to Console.gviweb
  Chat::WebSocket Client.jsli::CheckMessage
  Chat::subvis::Format Received Message.gviweb
  Chat::WebSocket Client.jsli::CloseWebSocket
diagram:
  Concatenate Strings("Welcome to EchoServer Chat!", "\r\n") -> w1
  # 1. Connects to the echo server.
  while {
    w2 = $"WebSocket URL"
    stop if $Connect
  }
  call "OpenWebSocket"(wsURI=w2) -> (error out=w3)
  # To reference external JavaScript files, you must add script tags to the HTML source panel.
  # This example uses the following script tags:
  #
  # <script src="javascript/WebSocketWrapper.js" type="application/javascript"></script>
  # 4. Disconnects from
  # the echo server.
  s1 = w1  # shift register
  while {
    Wait(time to wait=50)
    Is Empty String Or Path(string/path=$Message) -> w4
    Not(x=w4) -> w5
    Logical And(w5, $Send) -> w6
    # 2. Sends, logs to console,
    # and displays a message
    # every time the user clicks
    #  the Send button.
    case (w6) {
      frame False, Default {
        w7 = s1
        w8 = w3
      }
      frame True {
        call "Format Sent Message.gviweb"(Chat=s1, Message=$Message) -> (Formatted Message=w7)
        call "SendMessage"(message=$Message, error in=w3) -> (error out=w9)
        call "Format Log to Console.gviweb"(Input=$Message, error in=w9) -> (error out=w8)
      }
    }
    call "CheckMessage"(error in=w8) -> (lastMessage=w10, error out=w11)
    call "Format Received Message.gviweb"(Chat In=w7, lastMessage=w10) -> (Chat Out=w12)
    $Messages <- w12
    $"Send/Receive Error" <- w11
    # 3. Polls for the latest
    # message every iteration.
    # Displays only if the
    # latest message is not
    # an empty string.
    next s1 = w12
    stop if $Disconnect
  }
  call "CloseWebSocket"(error in=w11) -> (error out=w13)
  $"Close Error" <- w13
