vi "Get Time String.gviweb"   [LabVIEW NXG 3.0.0]
outputs:
  "TimeString": string
diagram:
  Get Current Time() -> (current time=w1)
  Get Date And Time String(time stamp=w1, want seconds? (F)=TRUE) -> (date string=w2, time string=w3)
  Concatenate Strings(w2, " ", w3) -> w4
  $TimeString <- w4
