vi "Compare Multiply.gviweb"   [LabVIEW NXG 3.0.0]
inputs:
  "X": u32
  "Y": u32
outputs:
  "Multi VI": u32
  "Multi JSLI (Decimal)": u32
  "Multiply JSLI": bool[]
  "Multiply JSLI Error": error
uses:
  Calculator::Calculator Functions.jsli::Multiply JSLI
diagram:
  Multiply($X, $Y) -> w1
  $"Multi VI" <- w1
  call "Multiply JSLI"(X=$X, Y=$Y, error in=no error) -> (return=w2, error out=w3)
  $"Multi JSLI (Decimal)" <- w2
  Number To Boolean Array(number=w2) -> (Boolean array=w4)
  $"Multiply JSLI" <- w4
  $"Multiply JSLI Error" <- w3
