vi "Main.gviweb"   [LabVIEW NXG 2.0.0]
panel controls:
  "Engine Link": string = "Engine.html"
  "Battery Link": string = "Energy.html"
  "Security Link": string = "Efficiency.html"
  "Emergency Link": string = "Emergency.html"
panel indicators:
  "Engine LED": bool
  "Energy LED": bool
  "Efficiency LED": bool
  "Emergency LED": bool
  "Auto Navigate Link": string
types:
  T1 = cluster{"Engine": bool, "Energy": bool, "Efficiency": bool, "Emergency": bool}
uses:
  Application::SubVIs::GetErrorStatus.gvi
diagram:
  # This example shows how Top-Level VIs can link to each other and Main.gviweb acts as the primary panel that links to other panels.
  #
  # The hyperlink controls in the Unplaced Items tray link to other Top-Level VIs using Relative Urls.
  # The Auto Navigate Link is updated dynamically to point to a different Top-Level VI based on the names of the VIs.
  # To determine what the Relative Url should be for a VI you can find the VI in the MultipleTopLevelVIs Component and look at the Relative URL propererty for that VI in the Right-Rail.
  while {
    call "GetErrorStatus.gvi"() -> (System with Error=w1)
    case (w1) {
      frame "Engine" {
        Property Node(instance in=T1 {all zero or empty}, "Engine"=TRUE) -> (instance out=w2)
      }
      frame "Energy" {
        Property Node(instance in=T1 {all zero or empty}, "Energy"=TRUE) -> (instance out=w2)
      }
      frame "Efficiency" {
        Property Node(instance in=T1 {all zero or empty}, "Efficiency"=TRUE) -> (instance out=w2)
      }
      frame "Emergency" {
        Property Node(instance in=T1 {all zero or empty}, "Emergency"=TRUE) -> (instance out=w2)
      }
    }
    Property Node(instance in=w2) -> ("Engine"=w3, "Energy"=w4, "Efficiency"=w5, "Emergency"=w6)
    $"Engine LED" <- w3
    $"Energy LED" <- w4
    $"Efficiency LED" <- w5
    $"Emergency LED" <- w6
    Format Into String(formatString="%s", w1) -> w7
    Concatenate Strings(w7, ".html") -> w8
    $"Auto Navigate Link" <- w8
    Wait(time to wait=2000)
    stop if FALSE
  }
