vi "Main.gviweb"   [LabVIEW NXG 3.1.0]
panel controls:
  "Engine Link": string = "Engine.html"
  "Battery Link": string = "Energy.html"
  "Security Link": string = "Efficiency.html"
  "Emergency Link": string = "Emergency.html"
  "Hyperlink Control": string = "https://github.com/ni/webvi-examples/tree/master/MultipleTopLevelWebVIs"
panel indicators:
  "Engine LED": bool
  "Energy LED": bool
  "Efficiency LED": bool
  "Emergency LED": bool
  "Auto Navigate Link": string
types:
  T1 = cluster{"Engine": bool, "Energy": bool, "Efficiency": bool, "Emergency": bool}
uses:
  Application::SubVIs::GetErrorStatus.gvi
diagram:
  # This example shows how Top-Level WebVIs can link to each other in a Web Application Component. The Top-Level WebVI named Main.gviweb acts as the first WebVI a user should visit. From Main.gviweb a user can click links to visit other Top-Level WebVIs.
  #
  # By writing to the Hyperlink Indicator in Main.gviweb the application is able to dynamically modify the URL of a Hyperlink control on the Front Panel based on the state of the application.
  #
  # To determine the Relative URL of a WebVI, open the MultipleTopLevelWebVIs Component and look at the Relative URL propererty for the WebVI in the Right-Rail.
  while {
    call "GetErrorStatus.gvi"() -> (System with Error=w1)
    case (w1) {
      frame "Engine" {
        Property Node(instance in=T1 {all zero or empty}, "Engine"=TRUE) -> (instance out=w2)
      }
      frame "Energy" {
        Property Node(instance in=T1 {all zero or empty}, "Energy"=TRUE) -> (instance out=w2)
      }
      frame "Efficiency" {
        Property Node(instance in=T1 {all zero or empty}, "Efficiency"=TRUE) -> (instance out=w2)
      }
      frame "Emergency" {
        Property Node(instance in=T1 {all zero or empty}, "Emergency"=TRUE) -> (instance out=w2)
      }
    }
    Property Node(instance in=w2) -> ("Engine"=w3, "Energy"=w4, "Efficiency"=w5, "Emergency"=w6)
    $"Engine LED" <- w3
    $"Energy LED" <- w4
    $"Efficiency LED" <- w5
    $"Emergency LED" <- w6
    Format Into String(formatString="%s", w1) -> w7
    Concatenate Strings(w7, ".html") -> w8
    $"Auto Navigate Link" <- w8
    Wait(time to wait=2000)
    stop if FALSE
  }
