vi "Emergency.gviweb"   [G Web Development Software 21.0.0]
panel indicators:
  "Data Grid": T1[]
  "banner": string
types:
  T1 = cluster{"Audit Time": string, "Airbag Wear": f64, "ABS": bool, "E-Brake": bool, "FTL": f64}
  T2 = cluster{"Audit Time": string, "Brake Wear": f64, "ABS": bool, "E-Brake": bool, "FTL": f64}
diagram:
  Get Current Time() -> (current time=w1)
  Timestamp To Double Precision Float(number=w1) -> (double precision float=w2)
  s1 = T2[] []  # shift register
  while (iteration -> i1) {
    Wait(time to wait=1000)
    To Double Precision Float(number=i1) -> w3
    Multiply(60, w3) -> w4
    Add(w2, w4) -> w5
    To Timestamp(number=w5) -> w6
    Format Into String(formatString="%<%I:%M:%S %p>T", w6) -> w7
    Quotient And Remainder(x=w3, y=33) -> (x-y*floor(x/y)=w8)
    Subtract(x=33, y=w8) -> w9
    Random Number() -> (number (0 to 1)=w10)
    Is Greater(x=w10, y=0.5) -> w11
    Random Number() -> (number (0 to 1)=w12)
    Is Greater(x=w12, y=0.5) -> w13
    Property Node(instance in=T2 {all zero or empty}, "ABS"=w11, "E-Brake"=w13, "Audit Time"=w7, "FTL"=w9, "Brake Wear"=w3) -> (instance out=w14)
    Build Array(w14, s1) -> w15
    $"Data Grid" <- w15
    next s1 = w15
    stop if FALSE
  }
