vi "Energy.gviweb"   [G Web Development Software 21.0.0]
panel indicators:
  "Battery Level": f64
  "Charging Battery": bool
  "banner": string
diagram:
  while {
    for (N = 100) (iteration -> i1) {
      Wait(time to wait=10)
      To Double Precision Float(number=i1) -> w1
      $"Battery Level" <- w1
      $"Charging Battery" <- TRUE
    }
    s1 = w1  # shift register
    while {
      Random Number() -> (number (0 to 1)=w2)
      Multiply(w2, 5) -> w3
      Random Number() -> (number (0 to 1)=w4)
      Is Less(x=w4, y=0.45) -> w5
      Select(s=w5, t=1, f=-1) -> w6
      Multiply(w3, w6) -> w7
      Add(s1, w7) -> w8
      In Range And Coerce(lower limit=0, upper limit=100, x=w8) -> (coerced(x)=w9)
      $"Battery Level" <- w9
      Is Less Or Equal To 0(x=w9) -> w10
      Wait(time to wait=50)
      $"Charging Battery" <- w5
      next s1 = w9
      stop if w10
    }
    stop if FALSE
  }
