vi "GetErrorStatus.gvi"   [LabVIEW NXG 2.0.0]
outputs:
  "System with Error": T1
types:
  T1 = enum{"Engine", "Energy", "Efficiency", "Emergency"}
diagram:
  Random Number() -> (number (0 to 1)=w1)
  Multiply(w1, 3) -> w2
  Round To Nearest(number=w2) -> w3
  To Unsigned Word Integer(number=w3) -> w4
  $"System with Error" <- w4
