vi "Example Display Error.gviweb"   [LabVIEW NXG 5.1.0]
inputs:
  "error in": error
diagram:
  case ($"error in") {
    frame Error, Default {
      Property Node(instance in=$"error in") -> ("code"=w1, "source"=w2)
      Format Into String(formatString="❗ Error %d occurred\n\nPossible reason(s):\n\n%s", w1, w2) -> w3
      One Button Dialog(button name ("OK")="Continue", message=w3)
    }
    frame No Error { }
  }
