vi "Build Array.gviweb"   [G Web Development Software 22.3.0]
panel controls:
  "Array of Numeric Data 1": i32[] = [0]
  "Array of Numeric Data 2": i32[] = [1, 2, 3]
  "Array of Numeric Data 3": i32[] = [1, 2, 3]
panel indicators:
  "Concatenated Array": i32[]
  "Appended Array": i32[][]
  "banner": string
diagram:
  # To switch between the two modes, select the Build Array node and toggle the Concatenate Inputs item in the Configuration pane.
  #
  # The Build Array node defaults to having one input. Add inputs to the node by resizing the node.
  #
  # In Concatenate Mode, inputs may be a mix of n-dimensional, and (n-1)-dimensional arrays (where n > 0). The Build Array node forms a new n-dimensional array from the concatenation of each item in the inputs.
  #
  # In Append Mode, all inputs must be n-dimensional arrays (where n > 0).  The Build Array node forms a new (n+1)-dimensional array from the appended inputs. If the lengths of the inputs do not match, the shorter input arrays are padded.
  Build Array($"Array of Numeric Data 1", $"Array of Numeric Data 2", $"Array of Numeric Data 3") -> w1
  $"Concatenated Array" <- w1
  Build Array($"Array of Numeric Data 1", $"Array of Numeric Data 2", $"Array of Numeric Data 3") -> w2
  $"Appended Array" <- w2
