vi "In Range and Coerce.gviweb"   [G Web Development Software 22.3.0]
panel controls:
  "Tab Control": i32
  "Input Array": f64[] = [1, 2, 3, 4, 5]
  "Upper Limit 4": f64 = 5
  "Lower Limit 4": f64 = 2
  "Input Array 2": f64[] = [1, 2, 3, 4, 5]
  "Lower Limit 5": f64[] = [0, 0, 1, 1, 2]
  "Upper Limit 5": f64[] = [3, 3, 4, 4, 5]
  "Cluster 2": T1 = {"Numeric 1"=78, "Numeric 2"=59, "Numeric 3"=87}
  "Upper Limits": T1 = {"Numeric 1"=100, "Numeric 2"=57, "Numeric 3"=99}
  "Lower Limits": T1 = {"Numeric 1"=75, "Numeric 2"=52, "Numeric 3"=81}
  "Cluster": T1 = {"Numeric 1"=7, "Numeric 2"=5, "Numeric 3"=3}
  "Upper Limit 3": f64 = 6
  "Lower Limit 3": f64 = 4
  "Upper Limit 2": string = "C"
  "Lower Limit 2": string = "A"
  "String": string = "B"
  "Tab": i32
  "Upper Limit": f64 = 87
  "Numeric": f64 = 47
  "Lower Limit": f64 = 5
panel indicators:
  "Coerced Array": f64[]
  "Array in Range?": bool[]
  "Aggregate Array in Range?": bool
  "Aggregate Cluster in Range?": bool
  "Coerced Cluster": T1
  "Cluster in Range?": T2
  "Coerced String": string
  "String in Range?": bool
  "banner": string
  "Coerced Numeric": f64
  "Numeric in Range?": bool
types:
  T1 = cluster{"Numeric 1": f64, "Numeric 2": f64, "Numeric 3": f64}
  T2 = cluster{"Numeric 1": bool, "Numeric 2": bool, "Numeric 3": bool}
diagram:
  # In Range and Coerce checks the numeric value against the specified upper and lower limits.
  In Range And Coerce[IncludeHighLimit=True](lower limit=$"Lower Limit", upper limit=$"Upper Limit", x=$Numeric) -> (In Range?=w1, coerced(x)=w2)
  $"Coerced Numeric" <- w2
  $"Numeric in Range?" <- w1
  # In Range and Coerce checks to see if the x value is between the lower limit and upper limit. If it is, In Range? is TRUE, and coerced(x) equals x. If it is not in range, In Range? returns FALSE, and coerced(x) returns the upper limit if x was higher than the range, or the lower limit if x was lower than the range. To specify whether to include the upper and lower limits in the range check, right-click the In Range and Coerce node and select Include Upper Limit and/or Include Lower Limit from the shortcut menu. In all of the code below, both options are selected. To change the comparison mode, right-click the In Range and Coerce node and select Compare Aggregates or Compare Elements from the shortcut menu.
  # With clusters in Compare Aggregates mode, only the first element in the cluster is checked against the range defined by the first elements in the upper and lower limit clusters.
  In Range And Coerce[ComparisonMode=CompareAggregates, IncludeHighLimit=True](lower limit=$"Lower Limits", upper limit=$"Upper Limits", x=$"Cluster 2") -> (In Range?=w3)
  $"Aggregate Cluster in Range?" <- w3
  # In Range and Coerce checks strings based on their ASCII numeric values, which means that the range check on strings is case sensitive.
  In Range And Coerce[IncludeHighLimit=True](lower limit=$"Lower Limit 2", upper limit=$"Upper Limit 2", x=$String) -> (In Range?=w4, coerced(x)=w5)
  $"Coerced String" <- w5
  # With arrays in Compare Elements mode, each value in the array is checked against the specified limits, with an array of Booleans returned for the In Range? result.
  In Range And Coerce[IncludeHighLimit=True](lower limit=$"Lower Limit 4", upper limit=$"Upper Limit 4", x=$"Input Array") -> (In Range?=w6, coerced(x)=w7)
  $"Coerced Array" <- w7
  $"String in Range?" <- w4
  $"Array in Range?" <- w6
  # With clusters in Compare Elements mode, each value in the cluster is checked against the specified limits, with a cluster of Booleans returned for the In Range? result.
  In Range And Coerce[IncludeHighLimit=True](lower limit=$"Lower Limit 3", upper limit=$"Upper Limit 3", x=$Cluster) -> (In Range?=w8, coerced(x)=w9)
  $"Coerced Cluster" <- w9
  # With arrays in Compare Aggregates mode, only the first element in the array is checked against the range defined by the first elements in the upper and lower limit arrays.
  In Range And Coerce[ComparisonMode=CompareAggregates, IncludeHighLimit=True](lower limit=$"Lower Limit 5", upper limit=$"Upper Limit 5", x=$"Input Array 2") -> (In Range?=w10)
  $"Aggregate Array in Range?" <- w10
  $"Cluster in Range?" <- w8
