vi "Basic Graph.gviweb"   [G Web Development Software 22.0.0]
panel controls:
  "Waveform 1 Samples": i32 = 100
  "Waveform 2 Samples": i32 = 200
  "Cycle": i32
  "Amplitude": f64
panel indicators:
  "Normalized Waveforms": waveform<f64>[]
  "Non-Normalized Waveforms": f64[][]
  "banner": string
uses:
  Application::Sine Wave generator.gviweb
diagram:
  call "Sine Wave generator.gviweb"(Cycles=2, Amplitude=1) -> (Sine Waveform=w1)
  Reciprocal(x=$"Waveform 2 Samples") -> w2
  Get Current Time() -> (current time=w3)
  Build Waveform Node(Y=w1, dt=w2, t0=w3) -> (output waveform=w4)
  # This is a SubVI to generate the Sine Waveform. Sine Waveform is
  # generated by taking Cycles and Amplitude as input
  call "Sine Wave generator.gviweb"(Cycles=$Cycle, Amplitude=$Amplitude) -> (Sine Waveform=w5)
  # Generate waveforms using the number
  # of samples specified on the panel.
  # For waveform 1, the example changes
  # the amplitude and number of cycles to
  # improve visualization of the concept.
  Reciprocal(x=$"Waveform 1 Samples") -> w6
  # Wire the data array, along with the inverse of the sample count, into the
  # Build Waveform node to normalize the waveforms. Then combine those
  # waveforms as before and wire into the normalized graph.
  Build Waveform Node(Y=w5, dt=w6, t0=w3) -> (output waveform=w7)
  Build Array(w7, w4) -> w8
  $"Normalized Waveforms" <- w8
  # Use the Build Array node to combine the
  # two arrays to display in the first graph.
  Build Array(w5, w1) -> w9
  $"Non-Normalized Waveforms" <- w9
