vi "Sine Wave generator.gviweb"   [G Web Development Software 21.0.0]
inputs:
  "Cycles": i32
  "Amplitude": f64
outputs:
  "Sine Waveform": f64[]
diagram:
  w1 = [0, 0.587785, 0.951057, 0.951057, 0.587785, 0, -0.587785, -0.951057, -0.951057, -0.587785]
  s1 = f64[] []  # shift register
  for (N = $Cycles) {
    Multiply(w1, $Amplitude) -> w2
    Insert Into Array(inArray=s1, new=w2) -> w3
    next s1 = w3
  }
  $"Sine Waveform" <- s1
