vi "Handling Common User Interface.gviweb"   [G Web Development Software 22.0.0]
panel controls:
  "Numeric Control": f64
  "Stop": bool
  "Play Button": bool
  "Vertical Slider": f64
  "String Input": string
panel indicators:
  "String Control": string
  "Captured Events": string
  "banner": string
diagram:
  # Clear control/indicator values.
  sequence {
    frame 0 {
      $"Captured Events" <- ""
      $"String Control" <- ""
    }
  }
  # The Event Structure is configured to execute when several different types of events occur on the panel of the Web VI while it is running. When an event occurs, the Captured Events string updates with information about the specific event that fired.
  s1 = ""  # shift register
  while {
    event {
      on "Numeric Control" Value changed {
        Number To Fractional String(number=$"Numeric Control") -> (F-format string=w3)
        w1 = default
        w2 = "Numeric Control"
        w4 = "Value Change"
      }
      on "Play Button" Value changed {
        w1 = default
        w2 = "Play Button"
        w3 = default
        w4 = "Value Change"
      }
      on "Stop" Value changed {
        w1 = $Stop
        w2 = "Stop"
        w3 = "Value Change"
        w4 = default
      }
      on "Vertical Slider" Value changed {
        Number To Fractional String(number=$"Vertical Slider") -> (F-format string=w3)
        w1 = default
        w2 = "Vertical Slider"
        w4 = "Value Change"
      }
      on "String Input" Value changed {
        w1 = default
        w2 = "String Control"
        w3 = $"String Input"
        w4 = "Value Change"
      }
    }
    Format Into String(formatString="%s: %s: %s\n", w2, w4, w3) -> w5
    Concatenate Strings(w5, s1) -> w6
    $"Captured Events" <- w6
    next s1 = w6
    stop if w1
  }
