vi "Function.gviweb"   [G Web Development Software 22.0.0]
panel controls:
  "Run State 1": bool
  "Run State 2": bool
  "Stop": bool
panel indicators:
  "banner": string
diagram:
  w1 = "Initialize"  # Type
  # A LabVIEW State Machine contains four basic elements fundamental to its execution:
  #
  # While Loop - Executes multiple iterations until a stop condition is met.
  # Case Structure - Contains unique sections of code which represent each state of your state machine.
  # State Enum - Defines all possible states of the state machine.
  # Shift Register - Contains the state specified by the previous iteration to execute during the current iteration.
  # State Machine While Loop
  # The state enum is a Type Definition, which means that any change to the source .gtype for the type definition will propagate to every instance of the type definition in your VIs. Right-click the state enum constant below and select Open Type Definition to open the source .gtype file.
  # The shift register is initialized with a state enum value of "Initialize", which runs the "Initialize" case of the case structure on the first iteration of the While Loop.
  # Scroll through the different frames of the State Machine Case Structure to observe all the possible states of this state machine.
  s1 = w1  # shift register
  while {
    # State Machine Case Structure
    case (s1) {
      frame "Initialize" {
        # Initialize - In this example, the only initialization required is to specify that the next state for the state machine is "Wait for Event".
        w4 = "Wait for Event"  # Next State
        w2 = w4
        w3 = default
      }
      frame "Wait for Event" {
        # Wait for Event - An Event Structure is used to monitor the user interface for events. In each frame of the Event Structure, the next state of the state machine is specified based on which button was pressed.
        # Note: If a user interface event occurs while a state other than "Wait for Event" is running, the event will be queued and its event frame will run the next time this Event Structure executes.
        event {
          on "Stop" Value changed {
            w5 = "Stop"  # Next State
            w2 = w5
          }
          on "Run State 1" Value changed {
            w6 = "State 1"  # Next State
            w2 = w6
          }
          on "Run State 2" Value changed {
            w7 = "State 2"  # Next State
            w2 = w7
          }
        }
        w3 = default
      }
      frame "State 1" {
        # State 1 - Display a dialog with a message specific to state 1, then return to the Wait for Event state.
        w8 = "Wait for Event"  # Next State
        # The One Button Dialog node displays the State 1 text.
        One Button Dialog(message="This is the State 1 message.")
        w2 = w8
        w3 = default
      }
      frame "State 2" {
        # The Two Button Dialog node displays the State 2 message
        # and returns a TRUE value if the user clicks "Yes".
        Two Button Dialog(F button name ("Cancel")="No", T button name ("OK")="Yes", message="Show State 3?") -> (T Button?=w9)
        # State 2 - Display a dialog box with a message specific to State 2, then go to State 3 if the user clicks "Yes".
        # Observe that a state machine can have extra logic that decides to
        #  transition to different states depending on events in the current state.
        w10 = "Wait for Event"  # State
        # Next State
        Select(s=w9, t="State 3", f=w10) -> w2
        w3 = default
      }
      frame "State 3" {
        # State 3 - Display a dialog box with a message specific to State 3 and return to the Wait for Event state.
        w11 = "Wait for Event"  # Next State
        # The One Button Dialog node displays the State 3 text.
        One Button Dialog(message="This is the State 3 message.")
        w2 = w11
        w3 = default
      }
      frame "Stop" {
        # Stop - exits the state machine.
        # (value not used)
        # Note that only the Stop state returns True to the State Machine While Loop stop condition.
        w12 = "Stop"  # State
        w2 = w12
        w3 = TRUE
      }
    }
    next s1 = w2
    stop if w3
  }
