vi "Read-Write Messages.gviweb"   [LabVIEW NXG 2.1.0]
panel controls:
  "Message to Publish": string
panel indicators:
  "Message Received": string
  "error write": error
  "Iteration": i32
  "error read": error
uses:
  NI::Skyline::Configuration::Open Configuration.gvi
  NI::Skyline::Configuration::Open Configuration API Key.gvi
  NI::Skyline::MessageHTTP::Open.gvi
  NI::Skyline::MessageHTTP::Subscribe.gvi
  NI::Skyline::MessageHTTP::Publish.gvi
  NI::Skyline::MessageHTTP::Read.gvi
diagram:
  disable {
    frame Enabled {
      # Enable this diagram to connect to a SystemLink Server  on your network
      call "Open Configuration.gvi"(server url="", username="", password="") -> (configuration=w2, error out=w1)
    }
    frame Disabled {
      # Enter server URL and API key here
      #
      # Enable this diagram to run in LabVIEW or your own web server
      #
      # Disable this diagram before hosting in SystemLink Cloud
      # https://www.systemlinkcloud.com/webapphosting
      call "Open Configuration API Key.gvi"(server url="https://api.systemlinkcloud.com", api key="") -> (configuration=w2, error out=w1)
    }
  }
  call "Open.gvi"(error in=w1, configuration=w2) -> (message session out=w3, error out=w4)
  call "Subscribe.gvi"(message session=w3, topic="basic.example.message.topic", error in=w4) -> (message session out=w5, error out=w6)
  while (iteration -> i1) {
    Wait(time to wait=200)
    Build Cluster($"Message to Publish", i1) -> w7
    Flatten To JSON(anything=w7, error in (no error)=w6) -> (JSON string=w8, error out=w9)
    call "Publish.gvi"(message session=w3, topic="basic.example.message.topic", message=w8, error in=w9) -> (error out=w10)
    $"error write" <- w10
    stop if FALSE
  }
  while {
    w11 = cluster{"Element 1": string, "Element 2": i32} {all zero or empty}
    call "Read.gvi"(message session=w5, timeout milliseconds=2000, error in=w6) -> (message=w12, error out=w13)
    Unflatten From JSON(JSON string=w12, error in (no error)=w13, type and defaults=w11) -> (error out=w14, value=w15)
    Property Node(instance in=w15) -> ("Element 1"=w16, "Element 2"=w17)
    $"Message Received" <- w16
    $Iteration <- w17
    $"error read" <- w14
    stop if FALSE
  }
