vi "Read-Write Tags.gviweb"   [LabVIEW NXG 2.1.0]
panel controls:
  "Hyperlink Control": string = "Read-Write Messages.html"
panel indicators:
  "Inner Temp (F)": f64
  "Outer Temp (F)": f64
  "error out": error
uses:
  NI::Skyline::Configuration::Open Configuration.gvi
  NI::Skyline::Configuration::Open Configuration API Key.gvi
  NI::Skyline::TagHTTP::Open Tag.gvi
  Basic Data Service Examples::Simulate Temperature.gvi
  NI::Skyline::TagHTTP::Write Tag (DBL).gvi
  NI::Skyline::TagHTTP::Read Tag (DBL).gvi
  NI::Skyline::Configuration::Close Configuration.gvi
diagram:
  disable {
    frame Enabled {
      # Enable this diagram to connect to a SystemLink Server  on your network
      call "Open Configuration.gvi"(server url="", username="", password="") -> (configuration=w2, error out=w1)
    }
    frame Disabled {
      # Enter server URL and API key here
      #
      # Enable this diagram to run in LabVIEW or your own web server
      #
      # Disable this diagram before hosting in SystemLink Cloud
      # https://www.systemlinkcloud.com/webapphosting
      call "Open Configuration API Key.gvi"(server url="https://api.systemlinkcloud.com", api key="") -> (configuration=w2, error out=w1)
    }
  }
  call "Open Tag.gvi"(path="SystemLink.Examples.Oven.Inside.Temp", data type="Double", error in=w1, configuration=w2) -> (tag out=w3, error out=w4)
  call "Open Tag.gvi"(path="SystemLink.Examples.Oven.Outside.Temp", data type="Double", error in=w1, configuration=w2) -> (tag out=w5, error out=w6)
  Merge Errors(w4, w6) -> (error out=w7)
  while {
    Wait(time to wait=2000)
    call "Simulate Temperature.gvi"(Starting Temp=70) -> (Temp (F)=w8)
    call "Simulate Temperature.gvi"(Starting Temp=400) -> (Temp (F)=w9)
    call "Write Tag (DBL).gvi"(tag in=w3, value=w9, error in=w7) -> (error out=w10)
    call "Write Tag (DBL).gvi"(tag in=w5, value=w8, error in=w10) -> (error out=w11)
    stop if w11
  }
  while {
    Wait(time to wait=2000)
    call "Read Tag (DBL).gvi"(tag in=w3, error in=w7) -> (value=w12, error out=w13)
    $"Inner Temp (F)" <- w12
    call "Read Tag (DBL).gvi"(tag in=w5, error in=w13) -> (value=w14, error out=w15)
    $"Outer Temp (F)" <- w14
    stop if w15
  }
  call "Close Configuration.gvi"(configuration=w2, error in=w15) -> (error out=w16)
  Merge Errors(w16, w11) -> (error out=w17)
  $"error out" <- w17
