vi "Simulate Temperature.gvi"   [LabVIEW NXG 2.1.0]
inputs:
  "Starting Temp": f64 = 80
  "Delta T": f64 = 0.01
outputs:
  "Temp (F)": f64
diagram:
  s1 = $"Starting Temp"  # shift register
  while {
    Random Number() -> (number (0 to 1)=w1)
    Multiply($"Delta T", w1) -> w2
    Multiply(s1, w2) -> w3
    Random Number() -> (number (0 to 1)=w4)
    Is Less(x=w4, y=0.5) -> w5
    Negate(x=w3) -> w6
    Select(s=w5, t=w3, f=w6) -> w7
    Add(s1, w7) -> w8
    next s1 = w8
    stop if TRUE
  }
  $"Temp (F)" <- s1
