vi "ReadTags.gviweb"   [LabVIEW NXG 2.1.0]
panel controls:
  "Hyperlink Control": string = "Read-Write Messages.html"
panel indicators:
  "Inner Temp (F)": f64
  "Outer Temp (F)": f64
  "error out": error
uses:
  NI::Skyline::Configuration::Open Configuration.gvi
  NI::Skyline::Configuration::Open Configuration API Key.gvi
  NI::Skyline::TagHTTP::Open Tag.gvi
  NI::Skyline::TagHTTP::Read Tag (DBL).gvi
  NI::Skyline::Configuration::Close Configuration.gvi
diagram:
  disable {
    frame Disabled {
      # Enable this diagram to connect to a SystemLink Server  on your network
      call "Open Configuration.gvi"(server url="", username="", password="") -> (configuration=w2, error out=w1)
    }
    frame Enabled {
      # Enter server URL and API key here
      #
      # Enable this diagram to run in LabVIEW or your own web server
      #
      # Disable this diagram before hosting in SystemLink Cloud
      # https://www.systemlinkcloud.com/webapphosting
      call "Open Configuration API Key.gvi"(server url="https://api.systemlinkcloud.com", api key="Eoxwit5j0gk6Y5jS3RM8L68OXBmJtGs84mZP8RV7B6") -> (configuration=w2, error out=w1)
    }
  }
  call "Open Tag.gvi"(path="Skyline.Examples.Oven.Inside.Temp", data type="Double", error in=w1, configuration=w2) -> (tag out=w3, error out=w4)
  call "Open Tag.gvi"(path="Skyline.Examples.Oven.Outside.Temp", data type="Double", error in=w1, configuration=w2) -> (tag out=w5, error out=w6)
  Merge Errors(w4, w6) -> (error out=w7)
  while {
    Wait(time to wait=200)
    call "Read Tag (DBL).gvi"(tag in=w3, error in=w7) -> (value=w8, error out=w9)
    $"Inner Temp (F)" <- w8
    call "Read Tag (DBL).gvi"(tag in=w5, error in=w9) -> (value=w10, error out=w11)
    $"Outer Temp (F)" <- w10
    stop if w11
  }
  call "Close Configuration.gvi"(configuration=w2, error in=w11) -> (error out=w12)
  Merge Errors(w12) -> (error out=w13)
  $"error out" <- w13
