vi "ReadWriteMessages.gviweb"   [LabVIEW NXG 2.1.0]
panel controls:
  "String to Publish": string
  "Enum": T1 = "State One"
  "Switch": bool
  "Publish": bool
  "deque message": bool
panel indicators:
  "Message Received": string
  "error write": error
  "Publisher Loop Iteration": i32
  "error read": error
  "List Box": i32
  "LED": bool
types:
  T1 = enum{"State One", "State Two ", "State Three", "State Four", "State Five"}
  "Message Cluster.gtype" = cluster{"Numeric": f64, "Switch": bool, "State": u16, "String": string}
uses:
  NI::Skyline::Configuration::Open Configuration.gvi
  NI::Skyline::Configuration::Open Configuration API Key.gvi
  NI::Skyline::MessageHTTP::Open.gvi
  NI::Skyline::MessageHTTP::Subscribe.gvi
  NI::Skyline::MessageHTTP::Publish.gvi
  NI::Skyline::MessageHTTP::Read.gvi
diagram:
  disable {
    frame Disabled {
      # Enable this diagram to connect to a SystemLink Server  on your network
      call "Open Configuration.gvi"(server url="", username="", password="") -> (configuration=w2, error out=w1)
    }
    frame Enabled {
      # Enter server URL and API key here
      #
      # Enable this diagram to run in LabVIEW or your own web server
      #
      # Disable this diagram before hosting in SystemLink Cloud
      # https://www.systemlinkcloud.com/webapphosting
      call "Open Configuration API Key.gvi"(server url="https://api.systemlinkcloud.com", api key="tVnGaELAnOM6nTPvZKNxTJSKUEvD1Vse4sOTnrLi3s") -> (configuration=w2, error out=w1)
    }
  }
  call "Open.gvi"(error in=w1, configuration=w2) -> (message session out=w3, error out=w4)
  call "Subscribe.gvi"(message session=w3, topic="example.message.topic", error in=w4) -> (message session out=w5, error out=w6)
  while (iteration -> i1) {
    Wait(time to wait=200)
    Property Node(instance in="Message Cluster.gtype" {all zero or empty}, "Numeric"=i1, "Switch"=$Switch, "State"=$Enum, "String"=$"String to Publish") -> (instance out=w7)
    Flatten To JSON(anything=w7, error in (no error)=w6) -> (JSON string=w8, error out=w9)
    case ($Publish) {
      frame False, Default {
        w10 = w9
      }
      frame True {
        call "Publish.gvi"(message session=w3, topic="example.message.topic", message=w8, error in=w9) -> (error out=w10)
      }
    }
    stop if w10
  }
  $"error write" <- w10
  s1 = uninitialised  # shift register
  while {
    case ($"deque message") {
      frame False, Default {
        w11 = w6
        w12 = s1
      }
      frame True {
        call "Read.gvi"(message session=w5, timeout milliseconds=2000, error in=w6) -> (dequeue status=w13, message=w14, error out=w15)
        case (w13) {
          frame False, Default {
            # Do not deserialize message data when the queue is empty.
            w11 = w15
            w12 = s1
          }
          frame True {
            Unflatten From JSON(JSON string=w14, error in (no error)=w15, type and defaults="Message Cluster.gtype" {all zero or empty}) -> (error out=w11, value=w12)
          }
        }
      }
    }
    Property Node(instance in=w12) -> ("Numeric"=w16, "Switch"=w17, "State"=w18, "String"=w19)
    $"Publisher Loop Iteration" <- w16
    $LED <- w17
    $"List Box" <- w18
    $"Message Received" <- w19
    next s1 = w12
    stop if w11
  }
  $"error read" <- w11
