vi "Main.gvi"   [LabVIEW NXG 2.1.0]
panel controls:
  "password": string
  "username": string
  "server url": string
  "Skyline.Examples.DataServices.int_control": bool
  "Skyline.Examples.DataServices.numeric_slider-control": f64
  "Skyline.Examples.DataServices.string_control": string
  "Skyline.Examples.Oven.Inside.Temp-slider-control": f64
  "Skyline.Examples.Oven.Outside.Temp-slider-control": f64
  "connect": bool
  "Tab": i32
  "Hyperlink Control": string = "http://github.com/ni/webvi-examples/tree/master/UtilizeSkylineDataServices"
  "auth picker": i32
  "api key": string
  "dequeue message": bool
  "Numeric": f64
  "Switch": bool
  "Enum": T1 = "State One"
  "String": string
  "Publish message": bool
panel indicators:
  "debugging tips": string
  "Skyline.Examples.DataServices.int_indicator": bool
  "Skyline.Examples.DataServices.numeric_chart-indicator": f64
  "Skyline.Examples.DataServices.string_indicator": string
  "Skyline.Examples.Oven.Inside.Temp-tank-indicator": f64
  "Skyline.Examples.Oven.Outside.Temp-tank-indicator": f64
  "Numeric Indicator": f64
  "Square LED": bool
  "Listbox": i32
  "String Indicator": string
  "Queued Messages Remaining": f64
types:
  T1 = enum{"State One", "State Two ", "State Three", "State Four", "State Five"}
  "Message Cluster.gtype" = cluster{"Numeric": f64, "Switch": bool, "State": u16, "String": string}
uses:
  NI::G Core::Error::Clear Error Cluster.gvi
  subvis::Initialize.gvi
  subvis::Read Example Tags.gvi
  subvis::Write Example Tags.gvi
  subvis::Update Remaining Queue Indicator.gvi
  subvis::Deque Message.gvi
  subvis::Publish Message.gvi
  subvis::Build Error Message.gvi
  subvis::Determine Next State.gvi
diagram:
  # This diagram is identical to Main.gviweb.
  s1 = uninitialised  # shift register
  s2 = uninitialised  # shift register
  s3 = "initialize"  # shift register
  s4 = uninitialised  # shift register
  while {
    Wait(time to wait=250)
    case (s3) {
      frame "initialize", Default {
        w5 = ["Skyline.Examples.DataServices.bool", "Skyline.Examples.DataServices.numeric", "Skyline.Examples.DataServices.string", "Skyline.Examples.Oven.Inside.Temp", "Skyline.Examples.Oven.Outside.Temp"]
        call "Clear Error Cluster.gvi"(error in=s1) -> (error out=w6)
        sequence {
          frame 0 {
            $"debugging tips" <- ""
          }
        }
        call "Initialize.gvi"(server url=$"server url", username=$username, password=$password, api key=$"api key", tag paths=w5, AuthPicker=$"auth picker", error in=w6) -> (SystemLink Connection=w3, error out=w2)
        w1 = "read-tags"
        w4 = default
      }
      frame "read-tags" {
        call "Read Example Tags.gvi"(SystemLink Connection=s2, error in=s1) -> (SystemLink Connection out=w3, example.skyline-data-services.int_indicator=w7, example.skyline-data-services.numeric_gauge-indicator=w8, example.skyline-data-services.string_indicator=w9, Skyline.Examples.Oven.Inside.Temp-tank-indicator=w10, Skyline.Examples.Oven.Outside.Temp-tank-indicator=w11, error out=w2)
        $"Skyline.Examples.DataServices.int_indicator" <- w7
        $"Skyline.Examples.DataServices.int_control" <- w7
        $"Skyline.Examples.DataServices.numeric_chart-indicator" <- w8
        $"Skyline.Examples.DataServices.numeric_slider-control" <- w8
        $"Skyline.Examples.DataServices.string_indicator" <- w9
        $"Skyline.Examples.DataServices.string_control" <- w9
        $"Skyline.Examples.Oven.Inside.Temp-tank-indicator" <- w10
        $"Skyline.Examples.Oven.Inside.Temp-slider-control" <- w10
        $"Skyline.Examples.Oven.Outside.Temp-slider-control" <- w11
        # Updates both controls and indicators to ensure that tag values aren't overwritten between swtiching tabs
        $"Skyline.Examples.Oven.Outside.Temp-tank-indicator" <- w11
        w1 = $Tab
        w4 = default
      }
      frame "write-tags" {
        call "Write Example Tags.gvi"(SystemLink Connection=s2, example.skyline-data-services.int_control=$"Skyline.Examples.DataServices.int_control", example.skyline-data-services.numeric_slider-control=$"Skyline.Examples.DataServices.numeric_slider-control", example.skyline-data-services.string_control=$"Skyline.Examples.DataServices.string_control", Skyline.Examples.Oven.Inside.Temp-slider-control=$"Skyline.Examples.Oven.Inside.Temp-slider-control", Skyline.Examples.Oven.Outside.Temp-slider-control=$"Skyline.Examples.Oven.Outside.Temp-slider-control", error in=s1) -> (SystemLink Connection out=w3, errror out=w2)
        w1 = $Tab
        w4 = default
      }
      frame "read-message" {
        call "Update Remaining Queue Indicator.gvi"(SystemLink Connection=s2, queue size=s4, error in=s1) -> (SystemLink Connection out=w12, updated queue sie=w4, Queued Messages Remaining=w13, error out=w14)
        $"Queued Messages Remaining" <- w13
        call "Deque Message.gvi"(SystemLink Connection=w12, deque message=$"dequeue message", error in=w14) -> (SystemLink Connection out=w3, Message Out=w15, error out=w2)
        Property Node(instance in=w15) -> ("Numeric"=w16, "Switch"=w17, "State"=w18, "String"=w19)
        $"Numeric Indicator" <- w16
        $"Square LED" <- w17
        $Listbox <- w18
        $"String Indicator" <- w19
        w1 = $Tab
      }
      frame "write-message" {
        Property Node(instance in="Message Cluster.gtype" {all zero or empty}, "Numeric"=$Numeric, "Switch"=$Switch, "State"=$Enum, "String"=$String) -> (instance out=w20)
        call "Publish Message.gvi"(SystemLink Connection=s2, publish=$"Publish message", Message Cluster=w20, error=s1) -> (SystemLink Connection out=w3, error out=w2)
        w1 = $Tab
        w4 = default
      }
      frame "error-no-skyline" {
        call "Build Error Message.gvi"(error in=s1) -> (error out=w2, error state=w21)
        $"debugging tips" <- w21
        w1 = s3
        w3 = s2
        w4 = default
      }
    }
    call "Determine Next State.gvi"(state in=w1, connect=$connect, error in=w2) -> (state out=w22, errror out=w23)
    next s1 = w23
    next s2 = w3
    next s3 = w22
    next s4 = w4
    stop if FALSE
  }
