vi "MobileTest-2.gviweb"   [LabVIEW NXG 2.1.0]
panel controls:
  "selector": bool
panel indicators:
  "tag test": bool
  "message test": bool
  "test": bool
  "error out": error
  "String": string
  "error out_2": error
uses:
  NI::Skyline::Configuration::Open Configuration API Key.gvi
  NI::Skyline::MessageHTTP::Open.gvi
  NI::Skyline::MessageHTTP::Subscribe.gvi
  NI::Skyline::TagHTTP::Open Tag.gvi
  NI::Skyline::TagHTTP::Write Tag (DBL).gvi
  NI::Skyline::MessageHTTP::Publish.gvi
  NI::Skyline::MessageHTTP::Read.gvi
  NI::Skyline::TagHTTP::Read Tag (DBL).gvi
diagram:
  w1 = "run test"  # Type
  s1 = w1  # shift register
  s2 = uninitialised  # shift register
  while {
    case (s1) {
      frame "run test", Default {
        $String <- "test running"
        call "Open Configuration API Key.gvi"(server url="https://api-dev.systemlinkcloud.com", api key="Yr1p_vF1n0PmrJYPT83XLU5pgcn0mGgko6I3MfeR87") -> (configuration=w4, error out=w5)
        call "Open.gvi"(error in=w5, configuration=w4) -> (message session out=w6, error out=w7)
        call "Subscribe.gvi"(message session=w6, topic="mobile-test3", error in=w7) -> (message session out=w8, error out=w9)
        $"error out_2" <- w9
        Random Number() -> (number (0 to 1)=w10)
        Multiply(w10, 100) -> w11
        Round To Nearest(number=w11) -> w12
        Format Into String(w12) -> w13
        call "Open Tag.gvi"(path="mobile-test.tag1", data type="Double", error in=w5, configuration=w4) -> (tag out=w14, error out=w15)
        call "Write Tag (DBL).gvi"(tag in=w14, value=w12, error in=w15) -> (tag out=w16, error out=w17)
        call "Publish.gvi"(message session=w8, topic="mobile-test3", message=w13, error in=w9) -> (message session out=w18, error out=w19)
        sequence {
          frame 0 {
            Wait(time to wait=250)
          }
        }
        call "Read.gvi"(message session=w18, error in=w19) -> (message=w20, error out=w21)
        call "Read Tag (DBL).gvi"(tag in=w16, error in=w17) -> (value=w22, error out=w23)
        Merge Errors(w21, w23) -> (error out=w24)
        $"error out" <- w24
        Is Equal(x=w20, y=w13) -> w25
        Is Equal(x=w22, y=w12) -> w26
        Property Node(instance in=w24) -> ("status"=w27)
        Not(x=w27) -> w28
        Logical And(w25, w26, w28) -> w3
        $test <- w3
        $"tag test" <- w26
        $"message test" <- w25
        w2 = "wait"
      }
      frame "wait" {
        w29 = "run test"  # Type
        w30 = "wait"  # Type
        Select(s=$selector, t=w29, f=w30) -> w2
        case (w2) {
          frame "run test", Default {
            $"error out" <- no error
            $"tag test" <- FALSE
            $"message test" <- FALSE
            $test <- FALSE
          }
          frame "wait" { }
        }
        Wait(time to wait=250)
        Select(s=s2, t="test pass", f="test fail") -> w31
        $String <- w31
        w3 = s2
      }
    }
    next s1 = w2
    next s2 = w3
    stop if FALSE
  }
