vi "MobileTest.gviweb"   [LabVIEW NXG 2.1.0]
panel controls:
  "Button": bool
panel indicators:
  "numeric test": bool
  "string test": bool
  "Output": error
  "test": bool
  "Result String": string
  "message test": bool
uses:
  subvis::Initialize.gvi
  subvis::Write Example Tags.gvi
  NI::Skyline::MessageHTTP::Publish.gvi
  NI::Skyline::MessageHTTP::Read.gvi
  subvis::Read Example Tags.gvi
diagram:
  disable {
    frame Disabled { }
    frame Enabled {
      # Enter server URL and API key here
      #
      # Enable this diagram to run in LabVIEW or your own web server
      #
      # Disable this diagram before hosting in SystemLink Cloud
      # https://www.systemlinkcloud.com/webapphosting
      w3 = "https://api.systemlinkcloud.com"  # server url
      w4 = "1G4ACkrS9kbI0RtdweM5dYa_TdoG-99qka7n1pD08e"  # api key
      w1 = w4
      w2 = w3
    }
  }
  w5 = "run test"  # State
  s1 = w5  # shift register
  s2 = uninitialised  # shift register
  while {
    case (s1) {
      frame "run test", Default {
        $"Result String" <- "Test Running..."
        for (N = 5) {
          Random Number() -> (number (0 to 1)=w9)
          append w9 to w8
        }
        Array Index(array=w8) -> (out1[_]=w10, out2[_]=w11)
        Format Into String(w11) -> w12
        Multiply(w10, 100) -> w13
        Round To Nearest(number=w13) -> w14
        w15 = ["mobiletest.bool", "mobiletest.numeric", "mobiletest.string", "mobiletest.Inside.Temp", "mobiletest.Outside.Temp"]
        call "Initialize.gvi"(server url=w2, api key=w1, tag paths=w15, AuthPicker="API Key") -> (SystemLink Connection=w16, error out=w17)
        call "Write Example Tags.gvi"(SystemLink Connection=w16, example.skyline-data-services.numeric_slider-control=w14, example.skyline-data-services.string_control=w12, error in=w17) -> (SystemLink Connection out=w18, errror out=w19)
        Property Node(instance in=w16) -> ("Message Configuration"=w20)
        call "Publish.gvi"(message session=w20, topic="example.message.topic", message=w12, error in=w17) -> (message session out=w21, error out=w22)
        sequence {
          frame 0 {
            Wait(time to wait=250)
          }
        }
        call "Read.gvi"(message session=w21, error in=w22) -> (message=w23, error out=w24)
        call "Read Example Tags.gvi"(SystemLink Connection=w18, error in=w19) -> (example.skyline-data-services.numeric_gauge-indicator=w25, example.skyline-data-services.string_indicator=w26, error out=w27)
        Merge Errors(w27, w24) -> (error out=w28)
        sequence {
          frame 0 {
            Is Equal(x=w14, y=w25) -> w29
            $"numeric test" <- w29
            Is Equal(x=w26, y=w12) -> w30
            $"string test" <- w30
            Is Equal(x=w12, y=w23) -> w31
            Property Node(instance in=w28) -> ("status"=w32)
            Not(x=w32) -> w33
            Logical And(w29, w30, w33, w31) -> w7
            $test <- w7
            $Output <- w28
            $"message test" <- w31
          }
        }
        w34 = "wait"  # State
        w6 = w34
      }
      frame "wait" {
        Wait(time to wait=100)
        w35 = "run test"  # State
        w36 = "wait"  # State
        Select(s=$Button, t=w35, f=w36) -> w37
        case (w37) {
          frame "run test", Default {
            $Output <- no error
            $test <- FALSE
            $"string test" <- FALSE
            $"numeric test" <- FALSE
            $"message test" <- FALSE
            w6 = w37
            w7 = FALSE
          }
          frame "wait" {
            w6 = w37
            w7 = s2
          }
        }
        Select(s=s2, t="Test pass", f="Test fail") -> w38
        $"Result String" <- w38
      }
    }
    next s1 = w6
    next s2 = w7
    stop if FALSE
  }
