vi "Main.gviweb"   [LabVIEW NXG 2.1.0]
panel controls:
  "Tab": i32
  "Skyline.Examples.DataServices.int_control": bool
  "Skyline.Examples.DataServices.numeric_slider-control": f64
  "Skyline.Examples.DataServices.string_control": string
  "Hyperlink Control": string = "http://github.com/ni/webvi-examples/tree/master/UtilizeSkylineDataServices"
  "password": string
  "username": string
  "connect": bool
  "server url": string
  "Skyline.Examples.Oven.Inside.Temp-slider-control": f64
  "Skyline.Examples.Oven.Outside.Temp-slider-control": f64
  "Authentication Credentials": i32
  "API Key": string
  "Numeric": f64
  "Switch": bool
  "Enum": T1 = "State One"
  "String": string
  "Publish": bool
panel indicators:
  "Skyline.Examples.DataServices.int_indicator": bool
  "Skyline.Examples.DataServices.string_indicator": string
  "debugging tips": string
  "Skyline.Examples.Oven.Inside.Temp-tank-indicator": f64
  "Skyline.Examples.Oven.Outside.Temp-tank-indicator": f64
  "Skyline.Examples.DataServices.numeric_indicator": f64
  "Numeric Indicator": f64
  "Boolean Indicator": bool
  "List Box": i32
  "String Indicator": string
types:
  T1 = enum{"State One", "State Two ", "State Three", "State Four", "State Five"}
  "Message Cluster.gtype" = cluster{"Numeric": f64, "Switch": bool, "State": u16, "String": string}
uses:
  NI::G Core::Error::Clear Error Cluster.gvi
  subvis::Initialize.gvi
  subvis::Read Example Tags.gvi
  subvis::Write Example Tags.gvi
  NI::Skyline::MessageHTTP::Read.gvi
  NI::Skyline::MessageHTTP::Publish.gvi
  subvis::Build Error Message.gvi
  subvis::Determine Next State.gvi
diagram:
  w1 = "initialize"  # State
  # This diagram is idenitcal to Main.gvi
  s1 = uninitialised  # shift register
  s2 = uninitialised  # shift register
  s3 = w1  # shift register
  while {
    Wait(time to wait=250)
    case (s3) {
      frame "initialize", Default {
        w5 = ["Skyline.Examples.DataServices.bool", "Skyline.Examples.DataServices.numeric", "Skyline.Examples.DataServices.string", "Skyline.Examples.Oven.Inside.Temp", "Skyline.Examples.Oven.Outside.Temp"]
        # Clear errors and try to connect to the Skyline server.
        call "Clear Error Cluster.gvi"(error in=s1) -> (error out=w6)
        sequence {
          frame 0 {
            $"debugging tips" <- ""
          }
        }
        call "Initialize.gvi"(server url=$"server url", username=$username, password=$password, api key=$"API Key", tag paths=w5, AuthPicker=$"Authentication Credentials", error in=w6) -> (SystemLink Connection=w4, error out=w3)
        # Read tags first to get their latest value
        w2 = "read-tags"
      }
      frame "read-tags" {
        # Updates both controls and indicators to ensure that tag values aren't overwritten with stale controls values after switching tabs
        call "Read Example Tags.gvi"(SystemLink Connection=s2, error in=s1) -> (SystemLink Connection out=w4, example.skyline-data-services.int_indicator=w7, example.skyline-data-services.numeric_gauge-indicator=w8, example.skyline-data-services.string_indicator=w9, Skyline.Examples.Oven.Inside.Temp-tank-indicator=w10, Skyline.Examples.Oven.Outside.Temp-tank-indicator=w11, error out=w3)
        $"Skyline.Examples.DataServices.int_indicator" <- w7
        $"Skyline.Examples.DataServices.int_control" <- w7
        $"Skyline.Examples.DataServices.numeric_slider-control" <- w8
        $"Skyline.Examples.DataServices.numeric_indicator" <- w8
        $"Skyline.Examples.DataServices.string_indicator" <- w9
        $"Skyline.Examples.DataServices.string_control" <- w9
        $"Skyline.Examples.Oven.Inside.Temp-tank-indicator" <- w10
        $"Skyline.Examples.Oven.Inside.Temp-slider-control" <- w10
        $"Skyline.Examples.Oven.Outside.Temp-slider-control" <- w11
        $"Skyline.Examples.Oven.Outside.Temp-tank-indicator" <- w11
        w2 = $Tab
      }
      frame "write-tags" {
        call "Write Example Tags.gvi"(SystemLink Connection=s2, example.skyline-data-services.int_control=$"Skyline.Examples.DataServices.int_control", example.skyline-data-services.numeric_slider-control=$"Skyline.Examples.DataServices.numeric_slider-control", example.skyline-data-services.string_control=$"Skyline.Examples.DataServices.string_control", Skyline.Examples.Oven.Inside.Temp-slider-control=$"Skyline.Examples.Oven.Inside.Temp-slider-control", Skyline.Examples.Oven.Outside.Temp-slider-control=$"Skyline.Examples.Oven.Outside.Temp-slider-control", error in=s1) -> (SystemLink Connection out=w4, errror out=w3)
        w2 = $Tab
      }
      frame "read-message" {
        Property Node(instance in=s2) -> ("Message Configuration"=w12, instance out=w4)
        call "Read.gvi"(message session=w12, error in=s1) -> (message=w13, error out=w14)
        Is Empty String Or Path(string/path=w13) -> w15
        case (w15) {
          frame True {
            # If the read message times out an empty string is returned and therefore we cannot update the indicators
            w3 = w14
          }
          frame False {
            Unflatten From JSON(JSON string=w13, error in (no error)=w14, type and defaults="Message Cluster.gtype" {all zero or empty}) -> (error out=w3, value=w16)
            Property Node(instance in=w16) -> ("Numeric"=w17, "Switch"=w18, "State"=w19, "String"=w20)
            $"Numeric Indicator" <- w17
            $"Boolean Indicator" <- w18
            $"List Box" <- w19
            $"String Indicator" <- w20
          }
        }
        w2 = $Tab
      }
      frame "write-message" {
        # Only publish when the user clicks the button. Otherwise a new message will be enqueued every iteration this state is active
        case ($Publish) {
          frame False, Default {
            w3 = s1
            w4 = s2
          }
          frame True {
            Property Node(instance in="Message Cluster.gtype" {all zero or empty}, "Numeric"=$Numeric, "Switch"=$Switch, "State"=$Enum, "String"=$String) -> (instance out=w21)
            Flatten To JSON(anything=w21, error in (no error)=s1) -> (JSON string=w22, error out=w23)
            Property Node(instance in=s2) -> ("Message Configuration"=w24, "Message Topic"=w25, instance out=w4)
            call "Publish.gvi"(message session=w24, topic=w25, message=w22, error in=w23) -> (error out=w3)
          }
        }
        w2 = $Tab
      }
      frame "error-no-skyline" {
        # If there is an error update the user by displaying troubleshooting tips
        call "Build Error Message.gvi"(error in=s1) -> (error out=w3, error state=w26)
        $"debugging tips" <- w26
        w2 = s3
        w4 = s2
      }
    }
    call "Determine Next State.gvi"(state in=w2, connect=$connect, error in=w3) -> (state out=w27, errror out=w28)
    next s1 = w28
    next s2 = w4
    next s3 = w27
    stop if FALSE
  }
