vi "Initialize.gvi"   [LabVIEW NXG 2.1.0]
inputs:
  "server url": string
  "username": string
  "password": string
  "error in": error
  "AuthPicker": "AuthPicker.gtype" = "User Name + Password"
  "api key": string
outputs:
  "error out": error
  "tags": "Tag.gtype"[]
types:
  "DataType.gtype" = enum{"Double", "Integer", "String"}
  "Client Handle.gtype" = u32
  "Configuration.gtype" = cluster{"Server URL": string, "Session": "Client Handle.gtype"}
  "Tag.gtype" = cluster{"Path": string, "Datatype": "DataType.gtype", "Configuration": "Configuration.gtype"}
  "AuthPicker.gtype" = enum{"User Name + Password", "API Key"}
uses:
  NI::Skyline::Configuration::Open Configuration.gvi
  NI::Skyline::Configuration::Open Configuration API Key.gvi
  NI::Skyline::TagHTTP::Open Tag.gvi
diagram:
  w1 = ["Skyline.Examples.DataServices.bool", "Skyline.Examples.DataServices.numeric", "Skyline.Examples.DataServices.string", "Skyline.Examples.Oven.Inside.Temp", "Skyline.Examples.Oven.Outside.Temp"]
  case ($AuthPicker) {
    frame "User Name + Password", Default {
      call "Open Configuration.gvi"(server url=$"server url", username=$username, password=$password, error in=$"error in") -> (configuration=w2, error out=w3)
    }
    frame "API Key" {
      call "Open Configuration API Key.gvi"(server url="https://helium-dataservices-dev.niwsc.com", api key=$"api key", error in=$"error in") -> (configuration=w2, error out=w3)
    }
  }
  Build Array("Integer", "Double", "String", "Double", "Double") -> w4
  for {
    w5 = each element of w1
    w6 = each element of w4
    call "Open Tag.gvi"(path=w5, data type=w6, error in=w3, configuration=w2) -> (tag out=w8, error out=w9)
    append w8 to w7
    stop if w9
  }
  $tags <- w7
  $"error out" <- w9
