vi "Update Remaining Queue Indicator.gvi"   [LabVIEW NXG 2.1.0]
inputs:
  "SystemLink Connection": T1
  "error in": error
  "queue size": i32
outputs:
  "SystemLink Connection out": T1
  "Queued Messages Remaining": f64
  "error out": error
  "updated queue sie": i32
types:
  "DataType.gtype" = enum{"Double", "Integer", "String"}
  "Tag.gtype" = cluster{"Path": string, "Datatype": "DataType.gtype", "Configuration": "Configuration.gtype"}
  "Message Session.gtype" = cluster{"Configuration": "Configuration.gtype", "token": string}
  T1 = cluster{"Tags": "Tag.gtype"[], "Message Topic": string, "Message Configuration": "Message Session.gtype"}
uses:
  NI::Skyline::MessageHTTP::Get Queue Size Bytes.gvi
diagram:
  case ($"error in") {
    frame Error, Default {
      w1 = $"error in"
      w2 = $"queue size"
      w3 = default
      w4 = $"SystemLink Connection"
    }
    frame No Error {
      Property Node(instance in=$"SystemLink Connection") -> ("Message Configuration"=w5, instance out=w4)
      call "Get Queue Size Bytes.gvi"(message session=w5, error in=$"error in") -> (queue size bytes=w6, error out=w1)
      Is Greater(x=w6, y=$"queue size") -> w7
      Select(s=w7, t=w6, f=$"queue size") -> w2
      Divide(x=w6, y=w2) -> w3
    }
  }
  $"error out" <- w1
  $"SystemLink Connection out" <- w4
  $"updated queue sie" <- w2
  $"Queued Messages Remaining" <- w3
