vi "Write Example Tags.gvi"   [LabVIEW NXG 2.1.0]
inputs:
  "example.skyline-data-services.int_control": bool
  "error in": error
  "SystemLink Connection": T1
  "example.skyline-data-services.numeric_slider-control": f64
  "example.skyline-data-services.string_control": string
  "Skyline.Examples.Oven.Outside.Temp-slider-control": f64
  "Skyline.Examples.Oven.Inside.Temp-slider-control": f64
outputs:
  "errror out": error
  "SystemLink Connection out": T1
types:
  "DataType.gtype" = enum{"Double", "Integer", "String"}
  "Tag.gtype" = cluster{"Path": string, "Datatype": "DataType.gtype", "Configuration": "Configuration.gtype"}
  "Message Session.gtype" = cluster{"Configuration": "Configuration.gtype", "token": string}
  T1 = cluster{"Tags": "Tag.gtype"[], "Message Topic": string, "Message Configuration": "Message Session.gtype"}
  "Client Handle.gtype" = u32
  "Configuration.gtype" = cluster{"Server URL": string, "Session": "Client Handle.gtype"}
  "Tag Value Cluster.gtype" = cluster{"Path": string, "Data Type": "DataType.gtype", "Value": string, "Time Stamp": timestamp}
  "Tag Cluster HTTP.gtype" = cluster{"Configuration": "Configuration.gtype", "Tag Cluster": "Tag Value Cluster.gtype"}
uses:
  NI::Skyline::TagHTTP::Write Tag (I32).gvi
  NI::Skyline::TagHTTP::Write Tag (DBL).gvi
  NI::Skyline::TagHTTP::Write Tag (String).gvi
  NI::Skyline::TagHTTP::Multi Write.gvi
diagram:
  $"SystemLink Connection out" <- $"SystemLink Connection"
  Property Node(instance in=$"SystemLink Connection") -> ("Tags"=w1)
  case ($"error in") {
    frame Error, Default {
      w2 = $"error in"
    }
    frame No Error {
      Boolean To Integer(Boolean=$"example.skyline-data-services.int_control") -> (0, 1=w3)
      disable {
        frame Enabled {
          Array Index(array=w1) -> (out0[_]=w4, out1[_]=w5, out2[_]=w6, out3[_]=w7, out4[_]=w8)
          call "Write Tag (I32).gvi"(tag in=w4, value=w3, error in=$"error in") -> (error out=w9)
          call "Write Tag (DBL).gvi"(tag in=w5, value=$"example.skyline-data-services.numeric_slider-control", error in=$"error in") -> (error out=w10)
          call "Write Tag (String).gvi"(tag in=w6, value=$"example.skyline-data-services.string_control", error in=$"error in") -> (error out=w11)
          call "Write Tag (DBL).gvi"(tag in=w7, value=$"Skyline.Examples.Oven.Inside.Temp-slider-control", error in=$"error in") -> (error out=w12)
          call "Write Tag (DBL).gvi"(tag in=w8, value=$"Skyline.Examples.Oven.Outside.Temp-slider-control", error in=$"error in") -> (error out=w13)
          Merge Errors(w9, w10, w11, w12, w13) -> (error out=w2)
        }
        frame Disabled {
          Format Into String(errIn=$"error in", w3) -> (outString=w14, errOut=w15)
          Format Into String(errIn=$"error in", $"example.skyline-data-services.numeric_slider-control") -> (outString=w16, errOut=w17)
          Format Into String(errIn=$"error in", $"Skyline.Examples.Oven.Inside.Temp-slider-control") -> (outString=w18, errOut=w19)
          Format Into String(errIn=$"error in", $"Skyline.Examples.Oven.Outside.Temp-slider-control") -> (outString=w20, errOut=w21)
          Merge Errors(w15, w17, w19, w21) -> (error out=w22)
          Build Array(w14, w16, $"example.skyline-data-services.string_control", w18, w20) -> w23
          for {
            w24 = each element of w1
            w25 = each element of w23
            Property Node(instance in=w24) -> ("Configuration"=w27, "Path"=w28, "Datatype"=w29)
            Property Node(instance in="Tag Cluster HTTP.gtype" {all zero or empty}, "Configuration"=w27, "Tag Cluster:Path"=w28, "Tag Cluster:Data Type"=w29, "Tag Cluster:Value"=w25) -> (instance out=w30)
            append w30 to w26
          }
          # Working around bug where multi write has an error in dependency.
          call "Multi Write.gvi"(tag clusters=w26, error in=w22) -> (error out=w2)
        }
      }
    }
  }
  $"errror out" <- w2
