vi "Write Example Tags.gviweb"   [LabVIEW NXG 2.0.0]
inputs:
  "error in": error
  "example.skyline-data-services.int_control": bool
  "tags in": "Tag.gtype"[]
  "example.skyline-data-services.string_control": string
  "example.skyline-data-services.numeric_slider-control": f64
outputs:
  "errror out": error
  "tags out": "Tag.gtype"[]
types:
  "DataType.gtype" = enum{"Double", "Integer", "String"}
  "Client Handle.gtype" = u32
  "Configuration.gtype" = cluster{"Server URL": string, "Session": "Client Handle.gtype"}
  "Tag.gtype" = cluster{"Path": string, "Datatype": "DataType.gtype", "Configuration": "Configuration.gtype"}
  "Tag Cluster Web.gtype" = cluster{"Path": string, "Data Type": "DataType.gtype", "Value": string, "Time Stamp": timestamp}
  "Tag Cluster HTTP.gtype" = cluster{"Configuration": "Configuration.gtype", "Tag Cluster": "Tag Cluster Web.gtype"}
uses:
  NI::Skyline::TagHTTP::Write Tag (I32).gvi
  NI::Skyline::TagHTTP::Write Tag (DBL).gvi
  NI::Skyline::TagHTTP::Write Tag (String).gvi
  NI::Skyline::TagHTTP::Multi Write.gvi
diagram:
  case ($"error in") {
    frame Error, Default {
      w1 = $"error in"
      w2 = $"tags in"
    }
    frame No Error {
      Boolean To Integer(Boolean=$"example.skyline-data-services.int_control") -> (0, 1=w3)
      disable {
        frame Enabled {
          Array Index(array=$"tags in") -> (out0[_]=w4, out1[_]=w5, out2[_]=w6)
          call "Write Tag (I32).gvi"(tag in=w4, value=w3, error in=$"error in") -> (error out=w7)
          # Working around bug where multi write has an error in dependency.
          call "Write Tag (DBL).gvi"(tag in=w5, value=$"example.skyline-data-services.numeric_slider-control", error in=$"error in") -> (error out=w8)
          call "Write Tag (String).gvi"(tag in=w6, value=$"example.skyline-data-services.string_control", error in=$"error in") -> (error out=w9)
          Merge Errors(w7, w8, w9) -> (error out=w1)
        }
        frame Disabled {
          Format Into String(errIn=$"error in", w3) -> (outString=w10, errOut=w11)
          Format Into String(errIn=w11, $"example.skyline-data-services.numeric_slider-control") -> (outString=w12, errOut=w13)
          Build Array(w10, w12, $"example.skyline-data-services.string_control") -> w14
          for {
            w15 = each element of $"tags in"
            w16 = each element of w14
            Property Node(instance in=w15) -> ("Configuration"=w18, "Path"=w19, "Datatype"=w20)
            Property Node(instance in="Tag Cluster HTTP.gtype" {all zero or empty}, "Configuration"=w18, "Tag Cluster:Path"=w19, "Tag Cluster:Data Type"=w20, "Tag Cluster:Value"=w16) -> (instance out=w21)
            append w21 to w17
          }
          call "Multi Write.gvi"(tag clusters=w17, error in=w13) -> (error out=w1)
        }
      }
      w2 = $"tags in"
    }
  }
  $"tags out" <- w2
  $"errror out" <- w1
